# Grasshopper definition generativeScript.gh (Grasshopper 1.0.7)

# ---- group: grid
curve = Curve([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])

# ---- group: site
curve_2 = Curve(<curve referenced from the Rhino model>)

# ----
# select site grid
brep = Brep(curve)
area = Area(Geometry=brep)  # -> Area, Centroid
point_in_curve = PointInCurve(Point=area.Centroid, Curve=curve_2)  # -> Relationship, Point

# ---- group: rectangles
cull_pattern = CullPattern(List=curve, CullPattern=point_in_curve.Relationship)

# ---- group: green
stream_gate = StreamGate(Stream=cull_pattern, Gate=Toggle(True))  # -> Target0, Target1

# ----
# input grid
crv = Curve(stream_gate.Target1)

panel = Panel("""{"Yellow":["Yellow","Green","Red","Idle","Fire"],
                    "Green":["Green","Yellow","Idle","Fire"],
                    "Red":["Red","Yellow","Idle","Fire"],
                    "Idle":["Green","Red","Yellow","Idle","Fire"],
"Fire":["Green","Red","Yellow","Idle","Fire"],}""")
toggle = BooleanToggle(False)

# ---- group: reset
button = Button()

# ----
python = GhPythonScript()  # -> out, a
# ---------- python: Python ----------
import random as rn
import ast

class WFC():
    # ───────────────────────────────────────────
    # constructor / reset
    # ───────────────────────────────────────────
    def __init__(self, in_graph, in_PR, rules):
        self.reset(in_graph, in_PR, rules)

    def reset(self, in_graph, in_PR, rules):
        self.PR    = in_PR
        self.map   = in_graph
        self.rules = rules

        self.types      = list(self.rules.keys())          # master list
        self.types_dict = self.create_empty_dict(self.rules)

        self.border_nodes         = []
        self.idle_nodes           = list(self.map.nodes)
        self.temp_checked_nodes   = []
        self.current_propagation  = 0
        self.conflicts            = 0

        self.init_entropy()

        # make every node “Idle” in bookkeeping
        for n in self.map.nodes:
            self.uncollapse_selected(n, add_to_border=False)

    # ───────────────────────────────────────────
    # WFC main loop  (unchanged)
    # ───────────────────────────────────────────
    def run_WFC(self):
        if not self.border_nodes:          # first collapse
            n = self.choose_random_starting_node()
            self.collapse_random_node(n)
            self.temp_checked_nodes = []
            self.check_node(n)
            self.update_border_nodes(n)
            self.current_propagation += 1
            return

        if not self.idle_nodes:
            return

        counter = 0
        success = False
        while not success and counter < len(self.idle_nodes):
            n = self.choose_random_border_node()
            success = self.collapse_random_node(n)
            counter += 1

        self.temp_checked_nodes = []
        self.check_node(n)
        self.update_border_nodes(n)
        self.current_propagation += 1

    # ───────────────────────────────────────────
    # entropy helper  (unchanged)
    # ───────────────────────────────────────────
    def init_entropy(self):
        n = self.choose_random_starting_node()
        self.temp_checked_nodes = []
        self.check_node(n)

    def check_node(self, node):
        if node in self.temp_checked_nodes: return
        self.temp_checked_nodes.append(node)

        for neigh in node.neighbour_nodes:
            old = neigh.possible_collapses
            new = self.find_available_collapses(neigh)
            if len(old) != len(new):
                neigh.possible_collapses = new
                neigh.entropy = len(new)
                self.check_node(neigh)

    def find_available_collapses(self, node):
        if node.type != "Idle":
            return [node.type]

        neighbour_sets = []
        for neigh in node.neighbour_nodes:
            neighbour_sets.append(self.types if neigh.type == "Idle"
                                            else self.rules[neigh.type])

        common = set(neighbour_sets[0])
        for s in neighbour_sets[1:]:
            common.intersection_update(s)
        return list(common)

    # ───────────────────────────────────────────
    # selection helpers  (unchanged)
    # ───────────────────────────────────────────
    def choose_random_starting_node(self):
        return self.idle_nodes[rn.randint(0, len(self.idle_nodes) - 1)]

    def choose_random_border_node(self):
        if self.border_nodes:
            return self.border_nodes[rn.randint(0, len(self.border_nodes) - 1)]
        return self.choose_random_starting_node()

    def update_border_nodes(self, node):
        for neigh in node.neighbour_nodes:
            if neigh.type == "Idle" and neigh not in self.border_nodes:
                self.border_nodes.append(neigh)

    # ───────────────────────────────────────────
    # collapse / un-collapse  **FIXED**
    # ───────────────────────────────────────────
    # 1️⃣  modify the helper
    def uncollapse_selected(self, node, add_to_border=True):
        prev = node.type
        node.type = "Idle"
    
        node.possible_collapses = list(self.types)
        if "Idle" in node.possible_collapses:
            node.possible_collapses.remove("Idle")
        node.entropy = len(node.possible_collapses)
    
        if node in self.types_dict.get(prev, []):
            self.types_dict[prev].remove(node)
        self.types_dict["Idle"].append(node)
    
        if node not in self.idle_nodes:
            self.idle_nodes.append(node)
    
        # add to border only if caller asks for it
        if add_to_border and node not in self.border_nodes:
            self.border_nodes.append(node)


    def collapse_selected(self, node, new_type):
        node.type = new_type
        node.possible_collapses = [new_type]
        self.types_dict[new_type].append(node)
        if node in self.idle_nodes:
            self.idle_nodes.remove(node)
        if node in self.border_nodes:
            self.border_nodes.remove(node)

    def collapse_random_node(self, node):
        possible = list(node.possible_collapses)
        for banned in ("Idle", "Fire"):
            if banned in possible:
                possible.remove(banned)

        possible = [
            t for t in possible
            if self.PR.counters_types_targets[t] - self.PR.counters_types[t] >= 0
        ]
        if not possible:
            self.conflicts += 1
            return False

        weights = [self.PR.probability_ratio[t] for t in possible]
        s = float(sum(weights))
        weights = [w/s for w in weights]

        choice = self.select_from_weighted_categories(possible, weights)
        self.PR.update_probability_ratio(choice)
        self.collapse_selected(node, choice)
        return True

    # ───────────────────────────────────────────
    # misc helpers  (unchanged)
    # ───────────────────────────────────────────
    def select_from_weighted_categories(self, opts, probs):
        r = rn.random()
        cum = 0
        for o, p in zip(opts, probs):
            cum += p
            if r <= cum:
                return o
        return opts[-1]

    @staticmethod
    def create_empty_dict(rule_dict):
        return {k: [] for k in rule_dict.keys()}


# ═════════════════════════════════════════════
# helper for GH inputs (unchanged)
# ═════════════════════════════════════════════
def str_to_dict(s):
    return ast.literal_eval(s.strip())


# ----------------- example instantiation (unchanged shell) -------------------
rules1 = str_to_dict(rules)
wfc    = WFC(graph, probability_ratio, rules1)

if RESET:
    rules2 = str_to_dict(rules)
    wfc.reset(graph, probability_ratio, rules2)
    print(wfc.types_dict)
# ---------- end python ----------
python_2 = GhPythonScript()  # -> out, a
# ---------- python_2: Python ----------
import random as rn
import ast

class WFC():
    def __init__(self, in_graph, in_PR, rules):
        self.PR = in_PR
        self.map = in_graph
        self.rules = rules
        #self.rules = {"Yellow":["Yellow","Green","Red","Idle"],
        #            "Green":["Green","Yellow","Idle"],
        #            "Red":["Red","Yellow","Idle"],
        #            "Idle":["Green","Red","Yellow","Idle"],}
        self.types = list(self.rules.keys())
        #self.types_dict = {"Yellow":[],"Green":[],"Red":[]}
        self.types_dict = self.create_empty_dict(self.rules)
        self.border_nodes = []
        self.current_propagation = 0
        self.idle_nodes = list(self.map.nodes)
        self.temp_checked_nodes = []
        self.init_entropy()
        self.conflicts = 0

    def run_WFC(self):
        # if first collapse choose a random starting node.
        if len(self.border_nodes)==0:
            node_to_collapse = self.choose_random_starting_node()
            # collapse that node
            self.collapse_random_node(node_to_collapse)
            # propagate the change to neighbours to update the collapses avaialble for each node
            self.temp_checked_nodes = []
            self.check_node(node_to_collapse)
            # update the nodes to select from
            self.update_border_nodes(node_to_collapse) # side thing update border
            # increase counter
            self.current_propagation = self.current_propagation +1
        else:
            if len(self.idle_nodes) != 0:
                counter = 0
                success = False
                while success == False:
                    # choose node with least entropy
                    node_to_collapse = self.choose_random_border_node()
                    # collapse node
                    success = self.collapse_random_node(node_to_collapse)
                    counter += 1
                    if counter == len(self.idle_nodes):
                        break
                # propagate the change to neighbours to update the collapses avaialble for each node
                self.temp_checked_nodes = []
                self.check_node(node_to_collapse)
                # update nodes to select from
                self.update_border_nodes(node_to_collapse) # side thing update border
                # increase counter
                self.current_propagation = self.current_propagation +1
                self.recursive_depth = 0
                
    def init_entropy(self):
        rand_node = self.choose_random_starting_node()
        self.temp_checked_nodes = []
        self.check_node(rand_node)
         
    def check_node(self, node):
        # safe so that it does not check in infitiy when recursive check is on
        if (node in self.temp_checked_nodes) == False:
            self.temp_checked_nodes.append(node)
            for neighbour_node in node.neighbour_nodes:
                
                # check current possible collapses
                pos_col_t0 = neighbour_node.possible_collapses
                # check if pos col was updated due to collapse of node
                pos_col_t1 = self.find_available_collapses(neighbour_node)
                # if pos_col changed, recursively update its value and check its neighbours
                if len(pos_col_t0) != len(pos_col_t1):
                    # update value
                    neighbour_node.possible_collapses = pos_col_t1
                    neighbour_node.entropy = len(pos_col_t1)
                    # check recursively check its neighbours IF NOT the node already has been checked
                    if (neighbour_node in self.temp_checked_nodes) == False:
                        self.check_node(neighbour_node)

    def find_available_collapses(self, node):
        if node.type == "Idle":
            possible_values_based_on_all_neighbours = [] # a list of lists with possible neighbours to each neighbour
            for neighbour_node in node.neighbour_nodes:
                # get a list of possible types based on each neighbours possible collapses
                if neighbour_node.type == "Idle":
                    allowed_neighbours_to_neighbour = self.types
                else:
                    allowed_neighbours_to_neighbour = self.rules[neighbour_node.type]
                possible_values_based_on_all_neighbours.append(allowed_neighbours_to_neighbour)
            # loop through the list created above and sort out the values that all neighbours can allow
            possible_values = []
            for i,possible_values_baed_on_neighbour in enumerate(possible_values_based_on_all_neighbours):
                if i == 0:
                    possible_values = list(possible_values_baed_on_neighbour) # if i = 0 create a starting point
                else: # else check if all values in the list are also present in the next list oterwise remove them
                    for value in possible_values:
                        if (value in possible_values_baed_on_neighbour) == False:
                            possible_values.remove(value)
            return possible_values
        else:
            return [node.type]
        
    def choose_random_starting_node(self):
        rand_node = self.idle_nodes[rn.randint(0, len(self.idle_nodes)-1)]
        return rand_node
    
    def select_from_weighted_categories(self, options, probabilities):
        # Calculate the cumulative probabilities
        cumulative_probabilities = []
        cumulative_probability = 0
        for p in probabilities:
            cumulative_probability += p
            cumulative_probabilities.append(cumulative_probability)
        # Generate a random integer between 1 and the sum of the probabilities
        rand_int = rn.randint(1, int(cumulative_probability * 100))
        # Iterate over the cumulative probabilities to find the corresponding option
        for i, cp in enumerate(cumulative_probabilities):
            if rand_int <= int(cp * 100):
                selected_category = options[i]
                break
        # Print the selected category
        return selected_category

    def choose_random_border_node(self):
        if len(self.border_nodes) != 0:
            rand_border_node = self.border_nodes[rn.randint(0,len(self.border_nodes)-1)]
        else:
            print("border_nodes are 0 proof: {a}".format(a=len(self.border_nodes)))
        return rand_border_node
    
    def update_border_nodes(self, node):
        for neighbour in node.neighbour_nodes:
            if neighbour.type == "Idle" and not neighbour in self.border_nodes:
                self.border_nodes.append(neighbour)
    
    def uncollapse_selected(self, node):
        previous_type = node.type
        # update probability ratio
        #self.PR.update_probability_ratio(selected_category) #TODO undo probability ratio
        rand_type = "Idle"
        # set node to that type
        node.type = rand_type
        possible_collapses = self.types
        if "Idle" in possible_collapses:
            possible_collapses.remove("Idle")
        node.possible_collapses = self.types
        self.entropy = len(node.possible_collapses)
        # register in WFC
        if node in self.types_dict[previous_type]:
            self.types_dict[previous_type].remove(node) 
        self.idle_nodes.append(node)
        # remove node if there were nodes in the border, (it was not the first start)
        self.border_nodes.append(node)
       
    def collapse_selected(self, node, selected_category):
        # update probability ratio
        #self.PR.update_probability_ratio(selected_category)
        rand_type = selected_category
        # set node to that type
        node.type = rand_type
        node.possible_collapses = [rand_type]
        # register in WFC
        self.types_dict[rand_type].append(node) 
        self.idle_nodes.remove(node)
        # remove node if there were nodes in the border, (it was not the first start)
        if node in self.border_nodes:
            self.border_nodes.remove(node)

    def collapse_random_node(self, node):
        # Define the dictionary of options and their probabilities
        options_dict = self.PR.probability_ratio
        # get the probabilities only for the available collapses and then compensate for the non avaiable.
        weights = []
        possible_collapses = list(node.possible_collapses)
        #print(possible_collapses)
        if "Idle" in possible_collapses:
            possible_collapses.remove("Idle")
        if "Fire" in possible_collapses:
            possible_collapses.remove("Fire")
        # OPTIONAL remove types that already have the max nr collapsed tiles
        for i,pos_col in enumerate(possible_collapses):
            if self.PR.counters_types_targets[pos_col] - self.PR.counters_types[pos_col] < 0:
                print("pos col was removed since targets - counters were less than 0")
                possible_collapses.remove(pos_col)
        for pos_col in possible_collapses:
            #print("type {a}".format(a=pos_col))
            #print(self.PR.counters_types[pos_col])
            weights.append(options_dict[pos_col])
        # compensate for taht the sum of weights may not be 100%
        sum_w = sum(weights)
        if sum_w != 0: # if there is no conflict 
            scale_factor_weights = sum_w/1
            for i in range(0,len(weights)):
                weights[i] = weights[i]/scale_factor_weights
            print("possible collapses: {a}".format(a=possible_collapses))
            print(weights)
            selected_category = self.select_from_weighted_categories(possible_collapses, weights)
            print("selected cateogry: {a}".format(a=selected_category))
        else:
            print("conflict")
            self.conflicts = self.conflicts +1 # conflict detected, the ratio will be off by this, rules trup ratio
            if len(possible_collapses) == 0:
                print("there were no possible collapses")
                return False
            else:
                selected_category = possible_collapses[rn.randint(0,len(possible_collapses)-1)]
                print("a random possible collapse was selected {a}".format(a=selected_category))
        # update probability ratio
        self.PR.update_probability_ratio(selected_category)
        rand_type = selected_category
        # set node to that type
        node.type = rand_type
        node.possible_collapses = [rand_type]
        # register in WFC
        self.types_dict[rand_type].append(node) 
        self.idle_nodes.remove(node)
        # remove node if there were nodes in the border, (it was not the first start)
        if len(self.border_nodes)!=0:
            self.border_nodes.remove(node)
    
    def create_empty_dict(self, input_dict):
        empty_dict = {}
        for key in input_dict.keys():
            empty_dict[key] = []
        return empty_dict
    
    def reset(self, in_graph, in_PR, rules):
        self.PR = in_PR
        self.map = in_graph
        self.rules = rules
        #self.rules = {"Yellow":["Yellow","Green","Red","Idle"],
        #            "Green":["Green","Yellow","Idle"],
        #            "Red":["Red","Yellow","Idle"],
        #            "Idle":["Green","Red","Yellow","Idle"],}
        self.types = list(self.rules.keys())
        #self.types_dict = {"Yellow":[],"Green":[],"Red":[]}
        self.types_dict = self.create_empty_dict(self.rules)
        self.border_nodes = []
        self.current_propagation = 0
        self.idle_nodes = list(self.map.nodes)
        self.temp_checked_nodes = []
        self.init_entropy()
        self.conflicts = 0
        
        for i in range(0,len(self.map.nodes)):
            self.uncollapse_selected(self.map.nodes[i])


#xxxxxxxxxxxxxxxxxxxxxxxxxxxxxxxxxxxxxxxxxxxxxxxxxxxxxxxxxxxxxxxxxxxxxxxxxxxxxxxxxxxxxxxxxxxxxxxxxxxxxxx
def str_to_dict(str_dict):
    str_dict = str_dict.strip()
    return ast.literal_eval(str_dict)

rules1 = str_to_dict(rules)
wfc = WFC(graph, probability_ratio, rules1)

if RESET:
    def str_to_dict(str_dict):
        str_dict = str_dict.strip()
        return ast.literal_eval(str_dict)
        
    rules2 = str_to_dict(rules)
    wfc.reset(graph, probability_ratio, rules2)
# ---------- end python_2 ----------
python_3 = GhPythonScript()  # -> out, a
# ---------- python_3: Python ----------
# -*- coding: utf-8 -*-
"""
Wave-Function-Collapse helper module
• DTO classes for (de)serialisation
• WFC engine with safe bookkeeping of types_dict etc.
"""
# ────────────────────────────────────────────────────────────
# Imports
# ────────────────────────────────────────────────────────────
import json
import os
import random as rn
import tempfile
import ast

# ────────────────────────────────────────────────────────────
# DTO Classes
# ────────────────────────────────────────────────────────────
class TileState(object):
    def __init__(self, node_num_id, tile_type, possible):
        self.node_num_id = node_num_id
        self.tile_type   = tile_type
        self.possible    = possible

    def to_dict(self):
        return {
            "node_num_id": self.node_num_id,
            "tile_type":   self.tile_type,
            "possible":    self.possible,
        }

class StateDto(object):
    VERSION = "0.1"                           # FIX ⟶ simple version tag

    def __init__(self,
                 tile_states,
                 idle_node_ids,
                 border_node_ids,
                 temp_checked_ids,
                 counters_types,
                 counters_types_targets,
                 current_propagation,
                 conflicts):
        self.tile_states            = tile_states
        self.idle_node_ids          = idle_node_ids
        self.border_node_ids        = border_node_ids
        self.temp_checked_ids       = temp_checked_ids
        self.counters_types         = counters_types
        self.counters_types_targets = counters_types_targets
        self.current_propagation    = current_propagation
        self.conflicts              = conflicts

    # ---------- serialisation helpers ----------
    def to_dict(self):
        return {
            "version":                StateDto.VERSION,  # FIX ⟶ include version
            "tile_states":            [ts.to_dict() for ts in self.tile_states],
            "idle_node_ids":          self.idle_node_ids,
            "border_node_ids":        self.border_node_ids,
            "temp_checked_ids":       self.temp_checked_ids,
            "counters_types":         self.counters_types,
            "counters_types_targets": self.counters_types_targets,
            "current_propagation":    self.current_propagation,
            "conflicts":              self.conflicts,
        }

    def to_json(self):
        return json.dumps(self.to_dict(), indent=2)

    # ---------- deserialisation helper ----------
    @staticmethod
    def from_dict(d):
        """Re-hydrate a StateDto from dict (keeps interface symmetrical)."""
        ts_objs = [TileState(**ts) for ts in d["tile_states"]]
        return StateDto(
            ts_objs,
            d["idle_node_ids"],
            d["border_node_ids"],
            d["temp_checked_ids"],
            d["counters_types"],
            d["counters_types_targets"],
            d["current_propagation"],
            d["conflicts"],
        )

# ────────────────────────────────────────────────────────────
# Convenience: build DTO from an active WFC
# ────────────────────────────────────────────────────────────
def build_wfc_dto(wfc):
    tile_states = [
        TileState(n.num_id, n.type, list(n.possible_collapses))
        for n in wfc.map.nodes
    ]

    return StateDto(
        tile_states           = tile_states,
        idle_node_ids         = [n.num_id for n in wfc.idle_nodes],
        border_node_ids       = [n.num_id for n in wfc.border_nodes],
        temp_checked_ids      = [n.num_id for n in getattr(wfc, "temp_checked_nodes", [])],
        counters_types        = dict(wfc.PR.counters_types),
        counters_types_targets= dict(wfc.PR.counters_types_targets),
        current_propagation   = wfc.current_propagation,
        conflicts             = wfc.conflicts,
    )

# ────────────────────────────────────────────────────────────
# File helper (safe path / permissions)
# ────────────────────────────────────────────────────────────
def save_state_json(state_dto, file_name="WFCState.json", ask_user=False):
    """
    Serialise `state_dto` to JSON.
    • Default: write to %TEMP% to avoid permission errors
    • If ask_user=True => open SaveFileDialog and use chosen path
    """
    file_name = (file_name or "WFCState.json").strip()
    if not file_name.lower().endswith(".json"):
        file_name += ".json"

    # choose target dir
    target_dir = tempfile.gettempdir()
    out_path   = os.path.join(target_dir, file_name)

    # Optional: UI dialog (only inside Rhino/Grasshopper desktop environment)
    if ask_user:
        try:
            import clr
            clr.AddReference("System.Windows.Forms")
            from System.Windows.Forms import SaveFileDialog
            dlg = SaveFileDialog()
            dlg.Filter    = "JSON files (*.json)|*.json"
            dlg.FileName  = file_name
            if dlg.ShowDialog() == dlg.DialogResult.OK:
                out_path = dlg.FileName
        except Exception:
            # silently fall back to temp if UI cannot open (e.g. headless)
            pass

    # write
    with open(out_path, "w") as fh:
        fh.write(state_dto.to_json())

    return out_path  # give caller the path for info

# ────────────────────────────────────────────────────────────
# Wave-Function-Collapse core class (fixed)
# ────────────────────────────────────────────────────────────
class WFC(object):
    """Minimal WFC engine with safe handling of self.types / types_dict."""

    # ---------- constructor ----------
    def __init__(self, in_graph, in_PR, rules):
        self.reset(in_graph, in_PR, rules)  # single source of truth

    # ---------- public API ----------
    def run_WFC(self):
        """One propagation / collapse step."""
        # first collapse: pick a random starting node
        if not self.border_nodes:
            node = self._choose_random_starting_node()
            self._collapse_random_node(node)
            self._propagate_from(node)
        # subsequent collapses
        elif self.idle_nodes:
            success = False
            counter = 0
            while not success and counter < len(self.idle_nodes):
                node = self._choose_random_border_node()
                success = self._collapse_random_node(node)
                counter += 1
            self._propagate_from(node)
        # else: no idle nodes left   → finished

    def reset(self, in_graph, in_PR, rules):
        """Full re-initialisation (also used by __init__)."""
        # core data
        self.PR    = in_PR
        self.map   = in_graph
        self.rules = rules

        # pre-computed helpers
        self.types       = list(self.rules.keys())  # KEEP MASTER LIST IMMUTABLE
        self.types_dict  = self._create_empty_dict(self.rules)
        self.border_nodes = []
        self.idle_nodes   = list(self.map.nodes)
        self.temp_checked_nodes = []
        self.current_propagation = 0
        self.conflicts = 0

        # initialise entropy constraints but *do not* collapse yet
        self._init_entropy()

    # ---------- internal helpers ----------
    def _propagate_from(self, node):
        """Re-propagate constraints after a collapse."""
        self.temp_checked_nodes = []
        self._check_node(node)                      # recursive
        self._update_border_nodes(node)
        self.current_propagation += 1

    # -- entropy initialisation ------------------------------------------------
    def _init_entropy(self):
        rand_node = self._choose_random_starting_node()
        self.temp_checked_nodes.clear()
        self._check_node(rand_node)

    def _check_node(self, node):
        if node in self.temp_checked_nodes:
            return
        self.temp_checked_nodes.append(node)

        for neighbour in node.neighbour_nodes:
            old = neighbour.possible_collapses
            new = self._find_available_collapses(neighbour)
            if len(old) != len(new):
                neighbour.possible_collapses = new
                neighbour.entropy            = len(new)
                if neighbour not in self.temp_checked_nodes:
                    self._check_node(neighbour)

    # -- core logic ------------------------------------------------------------
    def _find_available_collapses(self, node):
        if node.type != "Idle":
            return [node.type]

        per_neighbour = []
        for neigh in node.neighbour_nodes:
            allowed = self.types if neigh.type == "Idle" else self.rules[neigh.type]
            per_neighbour.append(allowed)

        # intersection of all neighbour option lists
        common = set(per_neighbour[0])
        for opts in per_neighbour[1:]:
            common.intersection_update(opts)
        return list(common)

    # -- selection helpers -----------------------------------------------------
    def _choose_random_starting_node(self):
        return self.idle_nodes[rn.randint(0, len(self.idle_nodes) - 1)]

    def _choose_random_border_node(self):
        if not self.border_nodes:
            # should never happen – but remain safe
            return self._choose_random_starting_node()
        return self.border_nodes[rn.randint(0, len(self.border_nodes) - 1)]

    def _update_border_nodes(self, node):
        for neigh in node.neighbour_nodes:
            if neigh.type == "Idle" and neigh not in self.border_nodes:
                self.border_nodes.append(neigh)

    # -- collapse / uncollapse -------------------------------------------------
    def _uncollapse_selected(self, node):
        prev_type = node.type
        node.type = "Idle"
        # FIX ⟶ use a copy so self.types remains intact
        node.possible_collapses = self.types.copy()
        node.entropy            = len(node.possible_collapses)

        if node in self.types_dict.get(prev_type, []):
            self.types_dict[prev_type].remove(node)
        if node not in self.idle_nodes:
            self.idle_nodes.append(node)
        if node in self.border_nodes:
            self.border_nodes.remove(node)

    def _collapse_selected(self, node, new_type):
        node.type              = new_type
        node.possible_collapses = [new_type]
        self.types_dict[new_type].append(node)
        if node in self.idle_nodes:
            self.idle_nodes.remove(node)
        if node in self.border_nodes:
            self.border_nodes.remove(node)

    def _collapse_random_node(self, node):
        # prepare candidate list (copy -> no side effects)
        possible = [t for t in node.possible_collapses if t not in ("Idle", "Fire")]
        # filter by remaining-targets logic, avoid mutating while iterating
        possible = [
            t for t in possible
            if self.PR.counters_types_targets[t] - self.PR.counters_types[t] >= 0
        ]

        if not possible:
            self.conflicts += 1
            return False  # collapse failed

        weights = [self.PR.probability_ratio[t] for t in possible]
        # normalise
        s = sum(weights)
        weights = [w / s for w in weights]

        # weighted random choice
        choice = self._select_from_weighted_categories(possible, weights)
        # update PR counters & collapse
        self.PR.update_probability_ratio(choice)
        self._collapse_selected(node, choice)
        return True

    # -- utilities -------------------------------------------------------------
    @staticmethod
    def _create_empty_dict(rule_dict):
        return {key: [] for key in rule_dict.keys()}

    @staticmethod
    def _select_from_weighted_categories(options, probabilities):
        cum = 0
        cumulative = []
        for p in probabilities:
            cum += p
            cumulative.append(cum)
        r = rn.random()
        for opt, cp in zip(options, cumulative):
            if r <= cp:
                return opt
        return options[-1]  # fallback (should not happen)

# ────────────────────────────────────────────────────────────
# Tiny CLI / test harness
# ────────────────────────────────────────────────────────────
if __name__ == "__main__":
    # dummy placeholders – replace with your real graph / PR objects
    class DummyNode:
        def __init__(self, i):
            self.num_id = i
            self.type   = "Idle"
            self.possible_collapses = ["Yellow", "Green", "Red", "Idle"]
            self.neighbour_nodes    = []
            self.entropy            = len(self.possible_collapses)

    class DummyGraph:
        def __init__(self, n=9):
            self.nodes = [DummyNode(i) for i in range(n)]
            # simple 3x3 neighbourhood for testing
            for idx, node in enumerate(self.nodes):
                neighbours = []
                for j in (-3, -1, 1, 3):
                    k = idx + j
                    if 0 <= k < n:
                        neighbours.append(self.nodes[k])
                node.neighbour_nodes = neighbours

    class DummyPR:
        def __init__(self):
            self.probability_ratio        = {"Yellow": 1, "Green": 1, "Red": 1}
            self.counters_types           = {"Yellow": 0, "Green": 0, "Red": 0}
            self.counters_types_targets   = {"Yellow": 5, "Green": 5, "Red": 5}
        def update_probability_ratio(self, t):
            self.counters_types[t] += 1

    dummy_rules = {
        "Yellow": ["Yellow", "Green", "Red", "Idle"],
        "Green":  ["Green", "Yellow", "Idle"],
        "Red":    ["Red", "Yellow", "Idle"],
        "Idle":   ["Green", "Red", "Yellow", "Idle"],
    }

    graph = DummyGraph()
    pr    = DummyPR()
    wfc   = WFC(graph, pr, dummy_rules)

    # run a few steps
    for _ in range(20):
        wfc.run_WFC()

    dto = build_wfc_dto(wfc)
    path = save_state_json(dto, ask_user=False)
    print("State saved to:", path)
# ---------- end python_3 ----------

# ---- group: curve
curve_3 = Curve(<curve referenced from the Rhino model>)

# ----
button_2 = Button()
panel_2 = Panel("C:\Users\bjorn\AppData\Local\Temp\test2.json")
python_4 = GhPythonScript()  # -> out, a
# ---------- python_4: Python ----------
import json
import clr

# Bring in System.IO to read files
clr.AddReference("System")
from System.IO import File

# ────────────────────────────────────────────────
# Main entry point
# ────────────────────────────────────────────────

def RunScript(filePath):
    stateDto  = None
    stateJson = None

    if filePath:
        try:
            # Read the entire file as a string
            stateJson = File.ReadAllText(filePath)

            # Parse into a Python dict
            stateDto = json.loads(stateJson)

        except Exception as e:
            # Print errors to the Rhino/GH console
            print("Error reading or parsing JSON:", e)

    # Outputs
    return stateDto, stateJson

stateDto, stateJson = RunScript(filePath)
# ---------- end python_4 ----------

# ---- group: curve
curve_4 = Curve(<curve referenced from the Rhino model>)

curve_5 = Curve(curve_4)

# ----
button_3 = Button()
python_5 = GhPythonScript()  # -> out, a
# ---------- python_5: Python ----------
"""
Save / Load WFC state  (two independent toggles)

IN  : saveJson      (bool / button)
      loadJson      (bool / button)
      fileName      (string)
      wfc_save      (WFC)
      wfc_loadInto  (WFC)

OUT : out           (log string)
      wfc_load      (WFC after optional loading)
"""

# ────────────────────────────────
# imports
# ────────────────────────────────
import json, clr
clr.AddReference("System")
from System.IO import Path, File

# ────────────────────────────────
# constants / helpers
# ────────────────────────────────
TMP_DIR   = Path.GetTempPath()
EPS_WEIGHT = 1e-3   # (not used here but keeps file self-contained)

def build_dto(wfc):
    tiles = []
    for i, nd in enumerate(wfc.map.nodes):
        k = getattr(nd, "id", None) or getattr(nd, "Id", None) or i
        tiles.append({"node_key": k,
                      "tile_type": nd.type,
                      "possible":  list(nd.possible_collapses)})
    return dict(tile_states = tiles,
                counters_types = dict(wfc.PR.counters_types),
                counters_types_targets = dict(wfc.PR.counters_types_targets),
                current_propagation = wfc.current_propagation,
                conflicts = wfc.conflicts)

def save_wfc(wfc, path):
    File.WriteAllText(path, json.dumps(build_dto(wfc), indent=2))

def read_json(path):
    if not File.Exists(path): return None
    try:  return json.loads(File.ReadAllText(path))
    except: return None

def dress_wfc(wfc, dto):
    key2node = {}
    for i, nd in enumerate(wfc.map.nodes):
        key2node[getattr(nd, "id", None) or getattr(nd, "Id", None) or i] = nd
    for t in wfc.types_dict: wfc.types_dict[t][:] = []
    wfc.idle_nodes[:], wfc.border_nodes[:] = [], []
    for ts in dto["tile_states"]:
        nd = key2node.get(ts["node_key"]);   # skip unknown keys
        if not nd: continue
        nd.type, nd.possible_collapses = ts["tile_type"], ts["possible"]
        nd.entropy = len(nd.possible_collapses)
        wfc.types_dict[nd.type].append(nd)
        if nd.type == "Idle": wfc.idle_nodes.append(nd)
    for nd in wfc.idle_nodes:
        if any(nb.type != "Idle" for nb in nd.neighbour_nodes):
            wfc.border_nodes.append(nd)
    wfc.PR.counters_types         = dto["counters_types"]
    wfc.PR.counters_types_targets = dto["counters_types_targets"]
    wfc.current_propagation       = dto.get("current_propagation",0)
    wfc.conflicts                 = dto.get("conflicts",0)
    # one quick re-propagate pass
    for nd in wfc.map.nodes:
        if nd.type != "Idle": wfc.check_node(nd)

# ────────────────────────────────
# build file path
# ────────────────────────────────
name = (fileName or "WFCState").strip()
if not name.lower().endswith(".json"): name += ".json"
fpath = Path.Combine(TMP_DIR, name)

# ────────────────────────────────
# main logic
# ────────────────────────────────
log_lines = []

# ------- SAVE -------
if saveJson:
    if wfc_save:
        try:
            save_wfc(wfc_save, fpath)
            log_lines.append("Saved state ➜ {}".format(fpath))
        except Exception as e:
            log_lines.append("SAVE ERROR: {}".format(e))
    else:
        log_lines.append("Nothing to save: wfc_save is None.")

# ------- LOAD -------
if loadJson:
    data = read_json(fpath)
    if data:
        if wfc_loadInto:
            try:
                dress_wfc(wfc_loadInto, data)
                log_lines.append("Loaded state ⇦ {}".format(fpath))
            except Exception as e:
                log_lines.append("LOAD ERROR: {}".format(e))
        else:
            log_lines.append("No fresh wfc_loadInto to dress.")
    else:
        log_lines.append("File not found or invalid JSON: {}".format(fpath))

# ────────────────────────────────
# outputs
# ────────────────────────────────
out = "\n".join(log_lines) if log_lines else "Idle."

# only send a dressed solver if loadJson actually ran successfully
if loadJson and 'Loaded state' in out:
    wfc_load = wfc_loadInto
else:
    wfc_load = None            # or keep wfc_loadInto if you prefer
# ---------- end python_5 ----------

# ---- group: curve
curve_6 = Curve([<curve referenced from the Rhino model> x2])

curve_7 = Curve(curve_6)

# ----
crv_2 = Curve(crv)
find_edges = GhPythonScript(plot_lines=crv_2, bool_get_corners=Toggle(False))  # -> nodes, edges, curves; inputs plot_lines: list of Curve, bool_get_corners: Boolean
# ---------- find_edges: Python ----------
import rhinoscriptsyntax as rs
import Rhino.Geometry as rg

def are_points_same(p1, p2):
        c1 = [int(p1[0]*1000),int(p1[1]*1000)]
        c2 = [int(p2[0]*1000),int(p2[1]*1000)]
        if c1 == c2:
            return True
        else:
            return False
def are_neighbours(cq1, cq2):
    q1 = cq1.ToPolyline()
    q2 = cq2.ToPolyline()
    nr_shared_pts = 0
    for i in range(4):
        pt1 = q1[i]
        for j in range(len(q2)):
            pt2 = q2[j]
            b_same = are_points_same(pt1,pt2)
            if b_same:
                nr_shared_pts = nr_shared_pts + 1
                break
    if nr_shared_pts >= 2:
        return True
    else:
        return False
    
def curve_centroid(curve):
    # Check if curve is closed and planar
    if curve.IsClosed and curve.IsPlanar():
        # Calculate centroid using CurveAreaCentroid method
        area, centroid = rs.CurveAreaCentroid(curve)
        return area
    else:
        # If curve is not closed or planar, return None
        return None

def curves_overlap(curve1, curve2):
    # Check if curves intersect
    intersection_pts = rs.CurveCurveIntersection(curve1, curve2)
    if intersection_pts is not None:
        # If there are intersection points, curves overlap
        return True
    else:
        # If there are no intersection points, curves do not overlap
        return False

# find neighoburs
def find_crv_neighbours(in_all_crvs, x, bool_get_corners):
    def are_points_same(p1, p2):
        c1 = [int(p1[0]*1000),int(p1[1]*1000)]
        c2 = [int(p2[0]*1000),int(p2[1]*1000)]
        if c1 == c2:
            return True
        else:
            return False
    # actual funciton-----------
    crv_neighbours = []
    for i,crv in enumerate(in_all_crvs):
        if bool_get_corners == False:
            if are_neighbours(x, crv):
                c1 = curve_centroid(x)
                c2 = curve_centroid(crv)
                if are_points_same(c1,c2)==False:
                    crv_neighbours.append(crv)
        if bool_get_corners == True:
            if curves_overlap(x, crv):
                c1 = curve_centroid(x)
                c2 = curve_centroid(crv)
                if are_points_same(c1,c2)==False:
                    crv_neighbours.append(crv)
    return crv_neighbours

# find neighbours pts
def find_centroids(crv_neighbours):
    centroids = []
    for neighbour in crv_neighbours:
        c = curve_centroid(neighbour)
        centroids.append(c)
    return centroids

# draw lines to neighbours centroids
def draw_lines(points, pt0):
    points = rs.coerce3dpointlist(points)
    cnt = len(points)
    lines = []
    for i in range(0, cnt):
        pt_s = points[i]
        line = rs.AddLine(pt_s, pt0)
        lines.append(line)
    return lines

def find_all_centroids(curves):
    centroids = []
    for c in curves:
        centroid = curve_centroid(c)
        centroids.append(centroid)
    return centroids
#---------------------------------------------------------------------
# draw it for all
all_lines = []
for crv in plot_lines:
    crv_neighbours = find_crv_neighbours(plot_lines, crv, bool_get_corners)
    centroids = find_centroids(crv_neighbours)
    lines = draw_lines(centroids, curve_centroid(crv))
    for line in lines:
        all_lines.append(line)

#--------------------------ouptus--------------------------------------
edges = all_lines
curves = plot_lines
nodes = find_all_centroids(plot_lines)
# ---------- end find_edges ----------
python_6 = GhPythonScript(RUN=Toggle(True), in_nodes_pts=find_edges.nodes, in_edges_crvs=find_edges.edges, in_tiles_crvs=find_edges.curves)  # -> out_graph; inputs in_nodes_pts: list of Point3d, in_edges_crvs: list of Curve, in_tiles_crvs: list of Curve
# ---------- python_6: Python ----------
import rhinoscriptsyntax as rs
import Rhino
import Rhino.Geometry as rg

class GlobalID:
    next = 0

    @classmethod
    def get(cls):
        val = cls.next
        cls.next += 1
        return val

if RUN == True:
    
    class Node:
        def __init__(self, node_pt):
            self.neighbour_nodes = []
            self.edges = []
            self.edges_crvs = []
            self.node_pt = node_pt
            self.id = "pt{a}".format(a=node_pt)
            self.num_id = GlobalID.get()
            self.crv = None
            self.type = "Idle"
            self.possible_collapses = ["Yellow","Green","Red"]
            self.entropy = len(self.possible_collapses)
    
    class Edge:
        def __init__(self, edge_crv):
            self.connection_nodes = []
            self.edge_crv = edge_crv
            self.id = "crv{a}{b}".format(a=edge_crv.PointAtStart, b=edge_crv.PointAtEnd)
            self.num_id = GlobalID.get()
    
    class Graph:
        def __init__(self):
            self.nodes = []
            self.edges = []
            self.edges_crvs = []
            self.nodes_pts = []
            self.coo_dict = {}
            self.num_id = GlobalID.get()
        def create_node(self, node_pt):
            node = Node(node_pt)
            self.nodes.append(node)
            self.nodes_pts.append(node_pt)
            return node
        def create_edge(self, edge_crv):
            edge = Edge(edge_crv)
            self.edges.append(edge)
            self.edges_crvs.append(edge_crv)
            return edge
        def create_coordiantes_dict(self):
            print("running")
            coo_d = {}
            for i,node in enumerate(self.nodes):
                x = int(node.node_pt[0]*10000)
                y = int(node.node_pt[1]*10000)
                key = "{a},{b}".format(a=x, b=y)
                self.coo_dict[key] = node
    
    in_graph = Graph()
    
    
    # XXXXXXXXXXXXXXXXXXXXXXXXXXXXXXXXXXXXXXXXXXXXXXXXXXXXXXXXXXXXXXXXXXXXXXXXXXXXX
    def find_node_relations(node_pt, in_nodes_pts, in_edges_crvs):
        #node_pt = in_nodes_pts[0]
        r_node = node_pt
        # ------------------------find edges
        def find_curves_on_point(point, curves):
            """Finds the curves in a list of curves that a point is on."""
            on_curves = []
            for curve in curves:
                t = rs.CurveClosestPoint(curve, point)
                # Get the closest point on the curve to your point 
                crv_pt = rs.EvaluateCurve(curve, t)
                # Measure the distance between both points
                dist = rs.Distance(point, crv_pt)
                if dist < Rhino.RhinoMath.ZeroTolerance:
                    on_curves.append(curve)
            return on_curves
        
        node_edges_crvs = find_curves_on_point(node_pt, in_edges_crvs)
        r_edges = node_edges_crvs
        
        # -------------------------find neighbours
        def point_on_crv(curve, point):
            tolerance = 0.001
            # Get the curve parameter
            t = rs.CurveClosestPoint(curve, point)
            # Get the closest point on the curve to your point 
            crv_pt = rs.EvaluateCurve(curve, t) 
            # Measure the distance between both points
            dist = rs.Distance(point, crv_pt)
            # Compare the distance to your tolerance
            if dist <= tolerance:
                #print "Point was indeed within %.2f distance." %(tolerance)
                return True
            else:
                #print "Point was not within %.2f distance." %(tolerance)
                return False
        
        def points_on_curves(points, curves, node_pt):
            pts_on_crvs = []
            for i in range(0, len(curves)):
                curve = curves[i]
                for j in range(0, len(points)):
                    point = points[j]
                    if point_on_crv(curve, point):
                        if node_pt != point:
                            pts_on_crvs.append(point)
            return pts_on_crvs
        
        node_neighbours_pts = points_on_curves(in_nodes_pts, node_edges_crvs, node_pt)
        r_neighbours = node_neighbours_pts
        
        return r_node, r_edges, r_neighbours
    
    
    def find_node_by_id(id):
        for i in range(0, len(in_graph.nodes)):
            node = in_graph.nodes[i]
            if node.id == id:
                return node
                break
    
    def find_edge_by_id(id):
        for i in range(0, len(in_graph.edges)):
            edge = in_graph.edges[i]
            if edge.id == id:
                return edge
                break
    
    
    def read_in_objects(in_graph, in_nodes_pts, in_edges_crvs):
        # loop through points and init them as objects
        for i in range(0, len(in_nodes_pts)):
            pt = in_nodes_pts[i]
            node = in_graph.create_node(pt)
        
        # loop through edges and init them as objects
        for i in range(0, len(in_edges_crvs)):
            crv = in_edges_crvs[i]
            node = in_graph.create_edge(crv)
        return in_graph
    
    # SCRIPT----------------------------------------------------------------------
    
    #XXXXXXXXXXXXXXXXXXXXXXXXXXXXXXXXXXXXXXXXXXXXXXXXXXXXXXXXXXXXXXXXXXXXXXXXXXXXX
    # STEP1: Read in all objects
    in_graph = read_in_objects(in_graph, in_nodes_pts, in_edges_crvs)
    in_graph.create_coordiantes_dict()
    
    #XXXXXXXXXXXXXXXXXXXXXXXXXXXXXXXXXXXXXXXXXXXXXXXXXXXXXXXXXXXXXXXXXXXXXXXXXXXXX
    # STEP2: Assign object relations
    # loop through all nodes
    for i in range(0, len(in_nodes_pts)):
        node_pt, edges_crvs, neighbours_pts = find_node_relations(in_nodes_pts[i], in_nodes_pts, in_edges_crvs)
        # find corresponding node object
        node = find_node_by_id("pt{a}".format(a=node_pt))
        # find edges objects
        edges = []
        for edge_crv in edges_crvs:
            edge = find_edge_by_id("crv{a}{b}".format(a=edge_crv.PointAtStart, b=edge_crv.PointAtEnd))
            edges.append(edge)
        # add edge relation to node
        node.edges = edges
        # add node relations to edge
        for edge in edges:
            edge.connection_nodes.append(node)
        
        # find neighbour objects
        neighbours = []
        for neighbour_pt in neighbours_pts:
            neighbour = find_node_by_id("pt{a}".format(a=neighbour_pt))
            neighbours.append(neighbour)
        # add neighbour relations to node
        node.neighbour_nodes = neighbours
    
    #XXXXXXXXXXXXXXXXXXXXXXXXXXXXXXXXXXXXXXXXXXXXXXXXXXXXXXXXXXXXXXXXXXXXXXXXXXXXXXXXXXXXX
    # STEP 3 Add curves to the graph
    def add_crvs_to_graph(crvs, graph):
        for node in graph.nodes:
            # Check if point is on surface
            for curve in crvs:
                inside_crv = curve.Contains(node.node_pt, rg.Plane.WorldXY, 0.001)
                if str(inside_crv) == "Inside":
                    node.crv = curve
    
    add_crvs_to_graph(in_tiles_crvs, in_graph)
    
    
    # SET OUTPUTS ----------------------------------------------------------------
    out_graph = in_graph
# ---------- end python_6 ----------

lng = ListLength(List=crv_2)
curve_8 = Curve(crv_2)

python_7 = GhPythonScript(
    RESET=button,
    RUN=Toggle(True),
    nr_plots=lng,
    target_ratios_percent="{\"Red\":0.1,\"Yellow\":0.5,\"Green\":0.4,\"Fire\":0.0}")  # -> probability_ratio, keys, adjusted_ratios, nr_of_each, conflicts; inputs nr_plots: Int32
# ---------- python_7: Python ----------
import math
import ast

if RUN == True:
    class ProbabilityRatio():
        def __init__(self, target_ratios_percent, nr_plots):
            #info
            #self.start_ratios = {'Green':0.2,'Red':0.2,'Yellow':0.6}
            self.start_ratios = target_ratios_percent
            self.total_nr_tiles = nr_plots
            self.time_step = 0
    
            # derrived
            self.counters_ratios = self.start_ratios
            self.counters_types = self.translate_prob_to_tiles()
            self.counters_types_targets = self.counters_types
            self.probability_ratio = self.init_propability_ratio()
        
        def init_propability_ratio(self):
            probability_ratio = {}
            for type in self.counters_types:
                probability_ratio[type] = self.counters_types[type]/(self.total_nr_tiles-self.time_step)
            return probability_ratio
    
        def update_probability_ratio(self, collapsed_type):
            self.time_step = self.time_step + 1 # why is this not needed??
    
            for tile_type in self.start_ratios:
                if self.time_step != self.total_nr_tiles:
                    if collapsed_type == tile_type:
                        # remove one avaialbel tile from the tiletype collapsed
                        self.counters_types[tile_type] = self.counters_types[tile_type] - 1
                        if self.counters_types[tile_type] < 0:
                            self.counters_types[tile_type] = 0
                        self.probability_ratio[tile_type] = self.counters_types[tile_type]/(self.total_nr_tiles-self.time_step)
                    else:
                        # split the 1 you removed from collapsed type on the others
                        self.probability_ratio[tile_type] = self.counters_types[tile_type]/(self.total_nr_tiles-self.time_step)
                else:
                    print("this is the last tile")
        def translate_prob_to_tiles(self):
            # get the floor value of the nr tiles times the ratio
            ratio_as_part_of_tiles = []
            whole_nrs = []
            differences = []
            biggest_difference_indexs = []
            for i,type in enumerate(self.start_ratios):
                ratio_as_part_of_tile = (self.total_nr_tiles * (self.start_ratios[type]))
                ratio_as_part_of_tiles.append(ratio_as_part_of_tile)
                whole_nr = math.floor(ratio_as_part_of_tile)
                whole_nrs.append(whole_nr)
                difference = ratio_as_part_of_tile-whole_nr
                differences.append(difference)
                # make a sorted list of the biggest differences
                if i == 0:
                    biggest_difference_indexs.append(0)
                else:
                    if differences[biggest_difference_indexs[0]] >= difference:
                        biggest_difference_indexs.append(i)
                    else:
                        biggest_difference_indexs.insert(0, i)
            # check how much rest there is
            rest  = self.total_nr_tiles - sum(whole_nrs)
    
            # insert rest at indexes of the biggest differences
            updated_whole_nrs = list(whole_nrs)
            for j,index in enumerate(biggest_difference_indexs):
                if differences[index] != 0:
                    updated_whole_nrs[index] = whole_nrs[index] + 1
                    rest = rest - 1
                    if rest == 0:
                        break
            # translate to dict
            dict_update_whole_nrs = {}
            for i,key in enumerate(self.start_ratios):
                dict_update_whole_nrs[key] = updated_whole_nrs[i]
    
            return dict_update_whole_nrs
    
    def str_to_dict(str_dict):
        str_dict = str_dict.strip()
        return ast.literal_eval(str_dict)
    
    # take the start ratios and deduct nr of each tiles that are likely -------------------------------------------------------------------------
    
    target_ratios_percent = str_to_dict(target_ratios_percent)
    probability_ratio = ProbabilityRatio(target_ratios_percent, nr_plots)
    
    keys = list(probability_ratio.probability_ratio.keys())
    adjusted_ratios = list(probability_ratio.probability_ratio.values())
    nr_of_each = list(probability_ratio.counters_types.values())
# ---------- end python_7 ----------
python_8 = GhPythonScript(RESET=button, graph=python_6, probability_ratio=python_7.probability_ratio, rules=panel)  # -> wfc
# ---------- python_8: Python ----------
import random as rn
import ast

# ───────────────────────────────────────────
# GLOBAL TUNABLES
# ───────────────────────────────────────────
EPS_WEIGHT = 1e-3          # minimum fallback weight so sum(weights) > 0

class WFC():
    # ───────────────────────────────────────────
    # constructor / reset
    # ───────────────────────────────────────────
    def __init__(self, in_graph, in_PR, rules):
        self.reset(in_graph, in_PR, rules)

    def reset(self, in_graph, in_PR, rules):
        self.PR    = in_PR
        self.map   = in_graph
        self.rules = rules

        # ensure every tile type has at least EPS_WEIGHT probability
        for k in self.PR.probability_ratio:
            self.PR.probability_ratio[k] = max(self.PR.probability_ratio[k], EPS_WEIGHT)

        self.types      = list(self.rules.keys())          # master list
        self.types_dict = self.create_empty_dict(self.rules)

        self.border_nodes         = []
        self.idle_nodes           = list(self.map.nodes)
        self.temp_checked_nodes   = []
        self.current_propagation  = 0
        self.conflicts            = 0                     # counts unsolved collapses

        self.init_entropy()

        # make every node “Idle” in bookkeeping
        for n in self.map.nodes:
            self.uncollapse_selected(n, add_to_border=False)

    # ───────────────────────────────────────────
    # WFC main loop  (unchanged)
    # ───────────────────────────────────────────
    def run_WFC(self):
        if not self.border_nodes:          # first collapse
            n = self.choose_random_starting_node()
            self.collapse_random_node(n)
            self.temp_checked_nodes = []
            self.check_node(n)
            self.update_border_nodes(n)
            self.current_propagation += 1
            return

        if not self.idle_nodes:
            return

        counter = 0
        success = False
        while not success and counter < len(self.idle_nodes):
            n = self.choose_random_border_node()
            success = self.collapse_random_node(n)
            counter += 1

        self.temp_checked_nodes = []
        self.check_node(n)
        self.update_border_nodes(n)
        self.current_propagation += 1

    # ───────────────────────────────────────────
    # entropy helper  (unchanged)
    # ───────────────────────────────────────────
    def init_entropy(self):
        n = self.choose_random_starting_node()
        self.temp_checked_nodes = []
        self.check_node(n)

    def check_node(self, node):
        if node in self.temp_checked_nodes: return
        self.temp_checked_nodes.append(node)

        for neigh in node.neighbour_nodes:
            old = neigh.possible_collapses
            new = self.find_available_collapses(neigh)
            if len(old) != len(new):
                neigh.possible_collapses = new
                neigh.entropy = len(new)
                self.check_node(neigh)

    def find_available_collapses(self, node):
        if node.type != "Idle":
            return [node.type]

        neighbour_sets = []
        for neigh in node.neighbour_nodes:
            neighbour_sets.append(self.types if neigh.type == "Idle"
                                            else self.rules[neigh.type])

        common = set(neighbour_sets[0])
        for s in neighbour_sets[1:]:
            common.intersection_update(s)
        return list(common)

    # ───────────────────────────────────────────
    # selection helpers  (unchanged)
    # ───────────────────────────────────────────
    def choose_random_starting_node(self):
        return self.idle_nodes[rn.randint(0, len(self.idle_nodes) - 1)]

    def choose_random_border_node(self):
        if self.border_nodes:
            return self.border_nodes[rn.randint(0, len(self.border_nodes) - 1)]
        return self.choose_random_starting_node()

    def update_border_nodes(self, node):
        for neigh in node.neighbour_nodes:
            if neigh.type == "Idle" and neigh not in self.border_nodes:
                self.border_nodes.append(neigh)

    # ───────────────────────────────────────────
    # collapse / un-collapse
    # ───────────────────────────────────────────
    def uncollapse_selected(self, node, add_to_border=True):
        prev = node.type
        node.type = "Idle"

        node.possible_collapses = list(self.types)
        if "Idle" in node.possible_collapses:
            node.possible_collapses.remove("Idle")
        node.entropy = len(node.possible_collapses)

        if node in self.types_dict.get(prev, []):
            self.types_dict[prev].remove(node)
        self.types_dict["Idle"].append(node)

        if node not in self.idle_nodes:
            self.idle_nodes.append(node)

        if add_to_border and node not in self.border_nodes:
            self.border_nodes.append(node)

    def collapse_selected(self, node, new_type):
        node.type = new_type
        node.possible_collapses = [new_type]
        self.types_dict[new_type].append(node)
        if node in self.idle_nodes:
            self.idle_nodes.remove(node)
        if node in self.border_nodes:
            self.border_nodes.remove(node)
        if node in self.types_dict["Idle"]:
            self.types_dict["Idle"].remove(node)

    def collapse_random_node(self, node):
        possible = list(node.possible_collapses)
        for banned in ("Idle", "Fire"):
            if banned in possible:
                possible.remove(banned)

        possible = [
            t for t in possible
            if self.PR.counters_types_targets[t] - self.PR.counters_types[t] >= 0
        ]
        if not possible:
            self.conflicts += 1
            return False

        # ---------- weight computation with EPS fallback ----------
        weights = [max(self.PR.probability_ratio[t], EPS_WEIGHT) for t in possible]
        total   = float(sum(weights))

        if total == 0.0:                     # safety: still impossible
            self.conflicts += 1
            return False

        weights = [w / total for w in weights]
        # -----------------------------------------------------------

        chosen = self.select_from_weighted_categories(possible, weights)
        self.PR.update_probability_ratio(chosen)
        self.collapse_selected(node, chosen)
        return True

    # ───────────────────────────────────────────
    # misc helpers  (unchanged)
    # ───────────────────────────────────────────
    def select_from_weighted_categories(self, opts, probs):
        r = rn.random()
        cum = 0.0
        for o, p in zip(opts, probs):
            cum += p
            if r <= cum:
                return o
        return opts[-1]

    @staticmethod
    def create_empty_dict(rule_dict):
        return {k: [] for k in rule_dict.keys()}


# ═════════════════════════════════════════════
# helper for GH inputs (unchanged)
# ═════════════════════════════════════════════
def str_to_dict(s):
    return ast.literal_eval(s.strip())


# ----------------- example instantiation (unchanged shell) -------------------
rules1 = str_to_dict(rules)
wfc    = WFC(graph, probability_ratio, rules1)

if RESET:
    rules2 = str_to_dict(rules)
    wfc.reset(graph, probability_ratio, rules2)
    print("Conflicts after reset:", wfc.conflicts)
# ---------- end python_8 ----------

python_9 = GhPythonScript(x=python_8)  # -> out, a
# ---------- python_9: Python ----------
__author__ = "bjorn"
__version__ = "2025.04.17"

import rhinoscriptsyntax as rs

a = x.map.nodes[0].num_id
# ---------- end python_9 ----------
panel_3 = Panel(python_9.a)
python_10 = GhPythonScript(wfc=python_8)  # -> out, stateDto, stateJson
# ---------- python_10: Python ----------
import json

def build_wfc_dto(wfc):
    """
    Produces a dict with all the state keyed by integer num_id.
    """
    # Per-node state
    tile_states = []
    for node in wfc.map.nodes:
        tile_states.append({
            "node_num_id":    node.num_id,
            "tile_type":      node.type,
            "possible":       list(node.possible_collapses)
        })

    # Collections by num_id
    idle_ids       = [n.num_id for n in wfc.idle_nodes]
    border_ids     = [n.num_id for n in wfc.border_nodes]
    temp_checked   = [n.num_id for n in getattr(wfc, "temp_checked_nodes", [])]

    # PR counters
    counters       = dict(wfc.PR.counters_types)
    targets        = dict(wfc.PR.counters_types_targets)

    # Scalars
    propagation    = wfc.current_propagation
    conflicts      = wfc.conflicts

    dto = {
        "tile_states":             tile_states,
        "idle_node_ids":           idle_ids,
        "border_node_ids":         border_ids,
        "temp_checked_ids":        temp_checked,
        "counters_types":          counters,
        "counters_types_targets":  targets,
        "current_propagation":     propagation,
        "conflicts":               conflicts
    }
    return dto

# Example usage:
stateDto  = build_wfc_dto(wfc)
stateJson = json.dumps(stateDto, indent=2)
# ---------- end python_10 ----------
panel_4 = Panel(python_10.stateDto)
python_11 = GhPythonScript(wfc=python_8)  # -> out, a
# ---------- python_11: Python ----------
a = wfc.idle_nodes[0].id
# ---------- end python_11 ----------
python_12 = GhPythonScript(wfc=python_8)  # -> out, stateDto, stateJson
# ---------- python_12: Python ----------
import json

def build_wfc_dto(wfc):
    """
    Constructs a serializable dict (DTO) from a WFC instance that uses integer node IDs.
    """
    # 1) Per‐node state
    tile_states = []
    for node in wfc.map.nodes:
        tile_states.append({
            "node_id":          node.id,
            "tile_type":        node.type,
            "possible":         list(node.possible_collapses)
        })

    # 2) Lists of IDs for the various node collections
    idle_node_ids      = [node.id for node in wfc.idle_nodes]
    border_node_ids    = [node.id for node in wfc.border_nodes]
    temp_checked_ids   = [node.id for node in getattr(wfc, "temp_checked_nodes", [])]

    # 3) PR counters
    counters_types         = dict(wfc.PR.counters_types)
    counters_types_targets = dict(wfc.PR.counters_types_targets)

    # 4) Scalar state
    current_propagation = wfc.current_propagation
    conflicts           = wfc.conflicts

    # 5) Assemble the DTO
    dto = {
        "tile_states":             tile_states,
        "idle_node_ids":           idle_node_ids,
        "border_node_ids":         border_node_ids,
        "temp_checked_ids":        temp_checked_ids,
        "counters_types":          counters_types,
        "counters_types_targets":  counters_types_targets,
        "current_propagation":     current_propagation,
        "conflicts":               conflicts
    }
    return dto

# --- Example usage in GhPython ---

# Assume `wfc` is your input WFC instance,
# and you have outputs named `stateDto` and `stateJson`:

stateDto  = build_wfc_dto(wfc)
stateJson = json.dumps(stateDto, indent=2)
# ---------- end python_12 ----------
python_13 = GhPythonScript(in_WFC=python_8, step=Button(), step10=Button(), step_all=Button())  # -> out, wfc, out_nodes; inputs step10: Int32
# ---------- python_13: Python ----------
if step == True:
    in_WFC.run_WFC()
    
if step10 == True:
    for i in range(0,10):
        in_WFC.run_WFC()
#print(in_WFC.find_available_collapses(in_WFC.map.nodes[2]))
if step_all == True:
    for i in range(0,len(in_WFC.idle_nodes)):
        in_WFC.run_WFC()
wfc = in_WFC
#out_nodes = in_WFC.map.nodes
# ---------- end python_13 ----------
python_14 = GhPythonScript(wfc=python_13.wfc)  # -> out, typeCounts
# ---------- python_14: Python ----------
# INPUT: wfc (your WFC instance)
# OUTPUT: typeCounts (list of strings for panel)

typeCounts = []

if hasattr(wfc, "types_dict"):
    for tile_type, nodes in wfc.types_dict.items():
        count = len(nodes)
        typeCounts.append("{}: {}".format(tile_type, count))
else:
    typeCounts.append("No types_dict found")
# ---------- end python_14 ----------
python_15 = GhPythonScript(in_PR=python_7.probability_ratio, rules=panel, in_graph=python_6, wfcDto=python_10.stateDto)  # -> out, wfc
# ---------- python_15: Python ----------
import random as rn
import json
import ast
class WFC:
    def __init__(self, in_graph, in_PR, rules, stateDto=None):
        # ────────────────────────────────────────────────
        # 1) Parse rules JSON if needed
        # ────────────────────────────────────────────────
        if isinstance(rules, str):
            try:
                rules = json.loads(rules)
            except ValueError as e:
                print("[WFC] Error parsing rules JSON:", e)
                rules = {}

        # ────────────────────────────────────────────────
        # 2) Parse stateDto JSON if needed
        # ────────────────────────────────────────────────
        if isinstance(stateDto, str):
            try:
                stateDto = json.loads(stateDto)
            except ValueError as e:
                print("[WFC] Error parsing stateDto JSON:", e)
                stateDto = None

        # ────────────────────────────────────────────────
        # 3) Core references
        # ────────────────────────────────────────────────
        self.map   = in_graph
        self.PR    = in_PR
        self.rules = rules

        # ────────────────────────────────────────────────
        # 4) Always rebuild types and empty dict
        # ────────────────────────────────────────────────
        self.types      = list(self.rules.keys())
        self.types_dict = self.create_empty_dict(self.rules)

        # ────────────────────────────────────────────────
        # 5) Fresh init vs. load from DTO
        # ────────────────────────────────────────────────
        if stateDto is None:
            # fresh initialization
            self.border_nodes       = []
            self.current_propagation = 0
            self.idle_nodes         = list(self.map.nodes)
            self.temp_checked_nodes = []
            self.init_entropy()
            self.conflicts = 0
        else:
            # load saved state
            self._apply_state(stateDto)

    def _apply_state(self, dto):
        # ────────────────────────────────────────────────
        # Build num_id → Node lookup
        # ────────────────────────────────────────────────
        id2node = { node.num_id: node for node in self.map.nodes }

        # ────────────────────────────────────────────────
        # Reset types_dict
        # ────────────────────────────────────────────────
        self.types_dict = self.create_empty_dict(self.rules)

        # ────────────────────────────────────────────────
        # Restore per-node tile state
        # ────────────────────────────────────────────────
        for ts in dto.get("tile_states", []):
            nid = ts.get("node_num_id")
            node = id2node.get(nid)
            if not node:
                print("[WFC] Warning: no node with num_id", nid)
                continue

            node.type               = ts.get("tile_type", node.type)
            node.possible_collapses = list(ts.get("possible", []))
            self.types_dict[node.type].append(node)

        # ────────────────────────────────────────────────
        # Restore node collections by num_id
        # ────────────────────────────────────────────────
        self.idle_nodes = [
            id2node[n] for n in dto.get("idle_node_ids", [])
            if n in id2node
        ]
        self.border_nodes = [
            id2node[n] for n in dto.get("border_node_ids", [])
            if n in id2node
        ]
        self.temp_checked_nodes = [
            id2node[n] for n in dto.get("temp_checked_ids", [])
            if n in id2node
        ]

        # ────────────────────────────────────────────────
        # Restore PR counters and scalars
        # ────────────────────────────────────────────────
        self.PR.counters_types         = dict(dto.get("counters_types", {}))
        self.PR.counters_types_targets = dict(dto.get("counters_types_targets", {}))
        self.current_propagation       = dto.get("current_propagation", 0)
        self.conflicts                 = dto.get("conflicts", 0)

    def create_empty_dict(self, base):
        return { k: [] for k in base.keys() }

###########################################################
    def run_WFC(self):
        # if first collapse choose a random starting node.
        if len(self.border_nodes)==0:
            node_to_collapse = self.choose_random_starting_node()
            # collapse that node
            self.collapse_random_node(node_to_collapse)
            # propagate the change to neighbours to update the collapses avaialble for each node
            self.temp_checked_nodes = []
            self.check_node(node_to_collapse)
            # update the nodes to select from
            self.update_border_nodes(node_to_collapse) # side thing update border
            # increase counter
            self.current_propagation = self.current_propagation +1
        else:
            if len(self.idle_nodes) != 0:
                counter = 0
                success = False
                while success == False:
                    # choose node with least entropy
                    node_to_collapse = self.choose_random_border_node()
                    # collapse node
                    success = self.collapse_random_node(node_to_collapse)
                    counter += 1
                    if counter == len(self.idle_nodes):
                        break
                # propagate the change to neighbours to update the collapses avaialble for each node
                self.temp_checked_nodes = []
                self.check_node(node_to_collapse)
                # update nodes to select from
                self.update_border_nodes(node_to_collapse) # side thing update border
                # increase counter
                self.current_propagation = self.current_propagation +1
                self.recursive_depth = 0
                
    def init_entropy(self):
        rand_node = self.choose_random_starting_node()
        self.temp_checked_nodes = []
        self.check_node(rand_node)
         
    def check_node(self, node):
        # safe so that it does not check in infitiy when recursive check is on
        if (node in self.temp_checked_nodes) == False:
            self.temp_checked_nodes.append(node)
            for neighbour_node in node.neighbour_nodes:
                
                # check current possible collapses
                pos_col_t0 = neighbour_node.possible_collapses
                # check if pos col was updated due to collapse of node
                pos_col_t1 = self.find_available_collapses(neighbour_node)
                # if pos_col changed, recursively update its value and check its neighbours
                if len(pos_col_t0) != len(pos_col_t1):
                    # update value
                    neighbour_node.possible_collapses = pos_col_t1
                    neighbour_node.entropy = len(pos_col_t1)
                    # check recursively check its neighbours IF NOT the node already has been checked
                    if (neighbour_node in self.temp_checked_nodes) == False:
                        self.check_node(neighbour_node)

    def find_available_collapses(self, node):
        if node.type == "Idle":
            possible_values_based_on_all_neighbours = [] # a list of lists with possible neighbours to each neighbour
            for neighbour_node in node.neighbour_nodes:
                # get a list of possible types based on each neighbours possible collapses
                if neighbour_node.type == "Idle":
                    allowed_neighbours_to_neighbour = self.types
                else:
                    allowed_neighbours_to_neighbour = self.rules[neighbour_node.type]
                possible_values_based_on_all_neighbours.append(allowed_neighbours_to_neighbour)
            # loop through the list created above and sort out the values that all neighbours can allow
            possible_values = []
            for i,possible_values_baed_on_neighbour in enumerate(possible_values_based_on_all_neighbours):
                if i == 0:
                    possible_values = list(possible_values_baed_on_neighbour) # if i = 0 create a starting point
                else: # else check if all values in the list are also present in the next list oterwise remove them
                    for value in possible_values:
                        if (value in possible_values_baed_on_neighbour) == False:
                            possible_values.remove(value)
            return possible_values
        else:
            return [node.type]
        
    def choose_random_starting_node(self):
        rand_node = self.idle_nodes[rn.randint(0, len(self.idle_nodes)-1)]
        return rand_node
    
    def select_from_weighted_categories(self, options, probabilities):
        # Calculate the cumulative probabilities
        cumulative_probabilities = []
        cumulative_probability = 0
        for p in probabilities:
            cumulative_probability += p
            cumulative_probabilities.append(cumulative_probability)
        # Generate a random integer between 1 and the sum of the probabilities
        rand_int = rn.randint(1, int(cumulative_probability * 100))
        # Iterate over the cumulative probabilities to find the corresponding option
        for i, cp in enumerate(cumulative_probabilities):
            if rand_int <= int(cp * 100):
                selected_category = options[i]
                break
        # Print the selected category
        return selected_category

    def choose_random_border_node(self):
        if len(self.border_nodes) != 0:
            rand_border_node = self.border_nodes[rn.randint(0,len(self.border_nodes)-1)]
        else:
            print("border_nodes are 0 proof: {a}".format(a=len(self.border_nodes)))
        return rand_border_node
    
    def update_border_nodes(self, node):
        for neighbour in node.neighbour_nodes:
            if neighbour.type == "Idle" and not neighbour in self.border_nodes:
                self.border_nodes.append(neighbour)
    
    def uncollapse_selected(self, node):
        previous_type = node.type
        # update probability ratio
        #self.PR.update_probability_ratio(selected_category) #TODO undo probability ratio
        rand_type = "Idle"
        # set node to that type
        node.type = rand_type
        possible_collapses = self.types
        if "Idle" in possible_collapses:
            possible_collapses.remove("Idle")
        node.possible_collapses = self.types
        self.entropy = len(node.possible_collapses)
        # register in WFC
        if node in self.types_dict[previous_type]:
            self.types_dict[previous_type].remove(node) 
        self.idle_nodes.append(node)
        # remove node if there were nodes in the border, (it was not the first start)
        self.border_nodes.append(node)
       
    def collapse_selected(self, node, selected_category):
        # update probability ratio
        #self.PR.update_probability_ratio(selected_category)
        rand_type = selected_category
        # set node to that type
        node.type = rand_type
        node.possible_collapses = [rand_type]
        # register in WFC
        self.types_dict[rand_type].append(node) 
        self.idle_nodes.remove(node)
        # remove node if there were nodes in the border, (it was not the first start)
        if node in self.border_nodes:
            self.border_nodes.remove(node)

    def collapse_random_node(self, node):
        # Define the dictionary of options and their probabilities
        options_dict = self.PR.probability_ratio
        # get the probabilities only for the available collapses and then compensate for the non avaiable.
        weights = []
        possible_collapses = list(node.possible_collapses)
        #print(possible_collapses)
        if "Idle" in possible_collapses:
            possible_collapses.remove("Idle")
        if "Fire" in possible_collapses:
            possible_collapses.remove("Fire")
        # OPTIONAL remove types that already have the max nr collapsed tiles
        for i,pos_col in enumerate(possible_collapses):
            if self.PR.counters_types_targets[pos_col] - self.PR.counters_types[pos_col] < 0:
                print("pos col was removed since targets - counters were less than 0")
                possible_collapses.remove(pos_col)
        for pos_col in possible_collapses:
            #print("type {a}".format(a=pos_col))
            #print(self.PR.counters_types[pos_col])
            weights.append(options_dict[pos_col])
        # compensate for taht the sum of weights may not be 100%
        sum_w = sum(weights)
        if sum_w != 0: # if there is no conflict 
            scale_factor_weights = sum_w/1
            for i in range(0,len(weights)):
                weights[i] = weights[i]/scale_factor_weights
            print("possible collapses: {a}".format(a=possible_collapses))
            print(weights)
            selected_category = self.select_from_weighted_categories(possible_collapses, weights)
            print("selected cateogry: {a}".format(a=selected_category))
        else:
            print("conflict")
            self.conflicts = self.conflicts +1 # conflict detected, the ratio will be off by this, rules trup ratio
            if len(possible_collapses) == 0:
                print("there were no possible collapses")
                return False
            else:
                selected_category = possible_collapses[rn.randint(0,len(possible_collapses)-1)]
                print("a random possible collapse was selected {a}".format(a=selected_category))
        # update probability ratio
        self.PR.update_probability_ratio(selected_category)
        rand_type = selected_category
        # set node to that type
        node.type = rand_type
        node.possible_collapses = [rand_type]
        # register in WFC
        self.types_dict[rand_type].append(node) 
        self.idle_nodes.remove(node)
        # remove node if there were nodes in the border, (it was not the first start)
        if len(self.border_nodes)!=0:
            self.border_nodes.remove(node)
    
    def create_empty_dict(self, input_dict):
        empty_dict = {}
        for key in input_dict.keys():
            empty_dict[key] = []
        return empty_dict
    
    def reset(self, in_graph, in_PR, rules):
        self.PR = in_PR
        self.map = in_graph
        self.rules = rules
        #self.rules = {"Yellow":["Yellow","Green","Red","Idle"],
        #            "Green":["Green","Yellow","Idle"],
        #            "Red":["Red","Yellow","Idle"],
        #            "Idle":["Green","Red","Yellow","Idle"],}
        self.types = list(self.rules.keys())
        #self.types_dict = {"Yellow":[],"Green":[],"Red":[]}
        self.types_dict = self.create_empty_dict(self.rules)
        self.border_nodes = []
        self.current_propagation = 0
        self.idle_nodes = list(self.map.nodes)
        self.temp_checked_nodes = []
        self.init_entropy()
        self.conflicts = 0
        
        for i in range(0,len(self.map.nodes)):
            self.uncollapse_selected(self.map.nodes[i])


#xxxxxxxxxxxxxxxxxxxxxxxxxxxxxxxxxxxxxxxxxxxxxxxxxxxxxxxxxxxxxxxxxxxxxxxxxxxxxxxxxxxxxxxxxxxxxxxxxxxxxxx
def str_to_dict(str_dict):
    str_dict = str_dict.strip()
    return ast.literal_eval(str_dict)

rules1 = str_to_dict(rules)
wfc = WFC(in_graph, in_PR, rules, stateDto=wfcDto)

if RESET:
    def str_to_dict(str_dict):
        str_dict = str_dict.strip()
        return ast.literal_eval(str_dict)
        
    rules2 = str_to_dict(rules)
    wfc.reset(graph, probability_ratio, rules2)
# ---------- end python_15 ----------
panel_5 = Panel(python_14.typeCounts)
python_16 = GhPythonScript(stateDto=python_10.stateDto)  # -> out, a
# ---------- python_16: Python ----------
# suppose stateDto is your dict

# 1) Get the entire counters_types sub‑dict:
counters = stateDto["counters_types"]
# Now ‘counters’ is itself a dict, e.g.
#   {'Yellow': 5, 'Green': 3, 'Red': 2}

# 2) Get a single value from it:
yellow_count = counters["Yellow"]

# 3) In one line:
yellow_count = stateDto["counters_types"]["Yellow"]

# 4) Safely, with .get() and a default:
yellow_count = stateDto.get("counters_types", {}).get("Yellow", 0)

# 5) Iterate over all tile types:
for tile_type, count in stateDto["counters_types"].items():
    print(tile_type, count)
# ---------- end python_16 ----------
panel_6 = Panel(python_11.a)
panel_7 = Panel(python_12.stateDto)
python_17 = GhPythonScript(wfc=python_13.wfc)  # -> out, lenIds
# ---------- python_17: Python ----------
# INPUT: wfc (Wave Function Collapse instance)
# OUTPUT: borderIds (list of integers or strings for Panel)

borderIds = []

if hasattr(wfc, "border_nodes"):
    borderIds = [n.num_id for n in wfc.border_nodes]
    print("Border node IDs:", len(borderIds))
    lenIds = len(borderIds)
    print(lenIds)
else:
    print("No 'border_nodes' found in WFC.")
# ---------- end python_17 ----------

# ---- group: grid
curve_9 = Curve(curve_8)

# ----
# collapse city ring
button_4 = Button()
cluster = Cluster(x=curve_9, y=curve_3, run=button_4, wfc=python_8, in_wfc=python_8, typology="Red")

panel_8 = Panel(python_17.lenIds)
python_18 = GhPythonScript(saveJson=Toggle(True), fileName="test2", wfc=python_8)  # -> out, stateDto, stateJson, filePath
# ---------- python_18: Python ----------
import json
import clr

# Bring in System.IO for file operations
clr.AddReference("System")
from System.IO import Path, File

# ─────────────────────────────────────────────────────
# 1) Build the DTO from your WFC instance
# ─────────────────────────────────────────────────────

# Extract tile states
tile_states = []
for i, node in enumerate(wfc.map.nodes):
    # Use a stable key if available
    node_key = getattr(node, "id", None) or getattr(node, "Id", None) or i
    tile_states.append({
        "node_key":         node_key,
        "tile_type":        node.type,
        "possible":         list(node.possible_collapses)
    })

# Extract PR counters
counter_types = { k: v for k, v in wfc.PR.counters_types.items() }
counter_targets = { k: v for k, v in wfc.PR.counters_types_targets.items() }

# Assemble the DTO
dto = {
    "tile_states":            tile_states,
    "counters_types":         counter_types,
    "counters_types_targets": counter_targets,
    "current_propagation":    wfc.current_propagation,
    "conflicts":              wfc.conflicts
}

# ─────────────────────────────────────────────────────
# 2) Serialize to JSON
# ─────────────────────────────────────────────────────

json_str = json.dumps(dto, indent=2)

# ─────────────────────────────────────────────────────
# 3) Determine output path in temp folder
# ─────────────────────────────────────────────────────

# Get system temp directory
temp_dir = Path.GetTempPath()

# Ensure a filename (fallback to WFCState.json)
fname = fileName.strip() if fileName else "WFCState.json"

# Add .json extension if missing
if not Path.GetExtension(fname):
    fname = fname + ".json"

# Combine into full path
full_path = Path.Combine(temp_dir, fname)

# ─────────────────────────────────────────────────────
# 4) Write file when triggered
# ─────────────────────────────────────────────────────

if saveJson:
    try:
        File.WriteAllText(full_path, json_str)
    except Exception as e:
        # Surface any IO errors in the Rhino command line
        print("Error saving JSON:", e)

# ─────────────────────────────────────────────────────
# 5) Outputs
# ─────────────────────────────────────────────────────

stateDto   = dto
stateJson  = json_str
filePath   = full_path
# ---------- end python_18 ----------
panel_9 = Panel(python_18.filePath)
panel_10 = Panel(python_18.stateJson)
panel_11 = Panel(python_18.stateDto)

# ---- group: grid
# uncollapse lines
curve_10 = Curve(curve_8)

# ----
# uncollapse lines
button_5 = Button()
cluster_2 = Cluster_2(x=curve_10, y=curve_5, wfc=cluster, run=button_5, in_wfc=cluster)

python_19 = GhPythonScript(filePath=panel_9, y=Button())  # -> out, stateDto, stateJson
# ---------- python_19: Python ----------
import json
import clr
clr.AddReference("System")
from System.IO import File

# ───────────────────────────────────────────────
# helpers
# ───────────────────────────────────────────────
def _as_string(fp):
    """Return the first element as a plain str, no matter the GH datatype."""
    if fp is None:
        return None

    # 1) already a Python / .NET string
    if isinstance(fp, basestring) or isinstance(fp, str):
        return fp.strip()

    # 2) a list / tuple / GH_IEnumerable with one item
    try:
        # GH wraps branches in lists; grab the first item
        if hasattr(fp, "__iter__"):
            first = next(iter(fp), None)
            if first is not None:
                return str(first).strip()
    except TypeError:
        pass

    # 3) fallback – just convert to str
    return str(fp).strip()

def load_state_from_path(fp):
    """Try to read JSON from `fp` → return (stateDto, stateJson) or (None, None)."""
    stateDto = None
    stateJson = None

    path_str = _as_string(fp)
    if not path_str:
        return None, None

    try:
        if File.Exists(path_str):
            stateJson = File.ReadAllText(path_str)
            stateDto  = json.loads(stateJson)
        else:
            print("File not found:", path_str)
    except Exception as e:
        print("Error reading or parsing JSON:", e)

    return stateDto, stateJson

# ───────────────────────────────────────────────
# main call – INPUT param is `filePath`
# ───────────────────────────────────────────────
stateDto, stateJson = load_state_from_path(filePath)
# ---------- end python_19 ----------
panel_12 = Panel(python_19.out)

# ---- group: grid
curve_11 = Curve(curve_8)

# ----
# collapse water ways
button_6 = Button()
cluster_3 = Cluster(x=curve_11, y=curve_4, run=button_6, wfc=cluster_2, in_wfc=cluster_2, typology="Green")

panel_13 = Panel(python_19.stateJson)
panel_14 = Panel(python_19.stateDto)
python_20 = GhPythonScript(RESET=button, graph=python_6, probability_ratio=python_7.probability_ratio, rules=panel)  # -> wfc; same code as python_8
# Working Saving and Loading Logic
python_21 = GhPythonScript(loadJson=Toggle(True), saveJson=Button(), fileName="test6", wfc_save=python_8, wfc_loadInto=python_20)  # -> out, wfc_load, file_path
# ---------- python_21: Python ----------
"""
Save / Load WFC state (two buttons)

INPUTS
------
saveJson      (bool / button)
loadJson      (bool / button)
fileName      (string)
wfc_save      (WFC)
wfc_loadInto  (WFC)

OUTPUTS
-------
out           (log string)
wfc_load      (WFC dressed on load, else None)
file_path     (string, absolute JSON location)
"""

# ─────────────────────────────
# imports & constants
# ─────────────────────────────
import json, clr
clr.AddReference("System")
from System.IO import Path, File

TMP_DIR = Path.GetTempPath()

# ─────────────────────────────
# utility: DTO builder
# ─────────────────────────────
def build_dto(wfc):
    tiles = []
    for i, nd in enumerate(wfc.map.nodes):
        key = getattr(nd, "id", None) or getattr(nd, "Id", None) or i
        tiles.append({"node_key": key,
                      "tile_type": nd.type,
                      "possible":  list(nd.possible_collapses)})
    return dict(tile_states = tiles,
                counters_types = dict(wfc.PR.counters_types),
                counters_types_targets = dict(wfc.PR.counters_types_targets),
                current_propagation = wfc.current_propagation,
                conflicts = wfc.conflicts)

# ─────────────────────────────
# SAVE helper   (no return)
# ─────────────────────────────
def save_WFC(wfc, path, log):
    if wfc is None:
        log.append("Nothing to save: wfc_save is None.")
        return
    try:
        dto_json = json.dumps(build_dto(wfc), indent=2)
        File.WriteAllText(path, dto_json)
        log.append("Saved state ➜ {}".format(path))
        log.append("✅ Successfully saved to: {}".format(path))
    except Exception as e:
        log.append("❌ SAVE ERROR: {}".format(e))

# ─────────────────────────────
# LOAD helper   (returns dressed or None)
# ─────────────────────────────
def load_WFC(wfc_fresh, path, log):
    if wfc_fresh is None:
        log.append("No fresh wfc_loadInto to dress.")
        return None
    if not File.Exists(path):
        log.append("File not found: {}".format(path))
        return None

    try:
        dto = json.loads(File.ReadAllText(path))
    except Exception as e:
        log.append("❌ JSON read/parse error: {}".format(e))
        return None

    # ---------- dress ----------
    key2node = {}
    for i, nd in enumerate(wfc_fresh.map.nodes):
        key2node[getattr(nd, "id", None) or getattr(nd, "Id", None) or i] = nd

    for t in wfc_fresh.types_dict: wfc_fresh.types_dict[t][:] = []
    wfc_fresh.idle_nodes[:], wfc_fresh.border_nodes[:] = [], []

    for ts in dto["tile_states"]:
        nd = key2node.get(ts["node_key"])
        if nd is None: continue
        nd.type, nd.possible_collapses = ts["tile_type"], ts["possible"]
        nd.entropy = len(nd.possible_collapses)
        wfc_fresh.types_dict[nd.type].append(nd)
        if nd.type == "Idle": wfc_fresh.idle_nodes.append(nd)

    for nd in wfc_fresh.idle_nodes:
        if any(nb.type != "Idle" for nb in nd.neighbour_nodes):
            wfc_fresh.border_nodes.append(nd)

    wfc_fresh.PR.counters_types         = dto["counters_types"]
    wfc_fresh.PR.counters_types_targets = dto["counters_types_targets"]
    wfc_fresh.current_propagation       = dto.get("current_propagation", 0)
    wfc_fresh.conflicts                 = dto.get("conflicts", 0)

    for nd in wfc_fresh.map.nodes:
        if nd.type != "Idle": wfc_fresh.check_node(nd)

    log.append("Loaded state ⇦ {}".format(path))
    log.append("✅ Successfully loaded from: {}".format(path))
    return wfc_fresh

# ─────────────────────────────
# build full file path
# ─────────────────────────────
fname = (fileName or "WFCState").strip()
if not fname.lower().endswith(".json"):
    fname += ".json"
file_path = Path.Combine(TMP_DIR, fname)

# ─────────────────────────────
# main flow
# ─────────────────────────────
log_lines = []

if saveJson:
    save_WFC(wfc_save, file_path, log_lines)

if loadJson:
    wfc_loaded = load_WFC(wfc_loadInto, file_path, log_lines)
else:
    wfc_loaded = None

# outputs
out        = "\n".join(log_lines) if log_lines else "Idle."
wfc_load   = wfc_loaded
file_path  = file_path
# ---------- end python_21 ----------
python_22 = GhPythonScript(
    stateDto=python_19.stateDto,
    stateJson=python_19.stateJson,
    graph=python_6,
    probability_ratio=python_7.probability_ratio,
    rules=panel)  # -> out, wfc
# ---------- python_22: Python ----------
# --------------------------- old WFC same as other node---------------------
import random as rn
import ast

# ───────────────────────────────────────────
# GLOBAL TUNABLES
# ───────────────────────────────────────────
EPS_WEIGHT = 1e-3          # minimum fallback weight so sum(weights) > 0

class WFC():
    # ───────────────────────────────────────────
    # constructor / reset
    # ───────────────────────────────────────────
    def __init__(self, in_graph, in_PR, rules):
        self.reset(in_graph, in_PR, rules)

    def reset(self, in_graph, in_PR, rules):
        self.PR    = in_PR
        self.map   = in_graph
        self.rules = rules

        # ensure every tile type has at least EPS_WEIGHT probability
        for k in self.PR.probability_ratio:
            self.PR.probability_ratio[k] = max(self.PR.probability_ratio[k], EPS_WEIGHT)

        self.types      = list(self.rules.keys())          # master list
        self.types_dict = self.create_empty_dict(self.rules)

        self.border_nodes         = []
        self.idle_nodes           = list(self.map.nodes)
        self.temp_checked_nodes   = []
        self.current_propagation  = 0
        self.conflicts            = 0                     # counts unsolved collapses

        self.init_entropy()

        # make every node “Idle” in bookkeeping
        for n in self.map.nodes:
            self.uncollapse_selected(n, add_to_border=False)

    # ───────────────────────────────────────────
    # WFC main loop  (unchanged)
    # ───────────────────────────────────────────
    def run_WFC(self):
        if not self.border_nodes:          # first collapse
            n = self.choose_random_starting_node()
            self.collapse_random_node(n)
            self.temp_checked_nodes = []
            self.check_node(n)
            self.update_border_nodes(n)
            self.current_propagation += 1
            return

        if not self.idle_nodes:
            return

        counter = 0
        success = False
        while not success and counter < len(self.idle_nodes):
            n = self.choose_random_border_node()
            success = self.collapse_random_node(n)
            counter += 1

        self.temp_checked_nodes = []
        self.check_node(n)
        self.update_border_nodes(n)
        self.current_propagation += 1

    # ───────────────────────────────────────────
    # entropy helper  (unchanged)
    # ───────────────────────────────────────────
    def init_entropy(self):
        n = self.choose_random_starting_node()
        self.temp_checked_nodes = []
        self.check_node(n)

    def check_node(self, node):
        if node in self.temp_checked_nodes: return
        self.temp_checked_nodes.append(node)

        for neigh in node.neighbour_nodes:
            old = neigh.possible_collapses
            new = self.find_available_collapses(neigh)
            if len(old) != len(new):
                neigh.possible_collapses = new
                neigh.entropy = len(new)
                self.check_node(neigh)

    def find_available_collapses(self, node):
        if node.type != "Idle":
            return [node.type]

        neighbour_sets = []
        for neigh in node.neighbour_nodes:
            neighbour_sets.append(self.types if neigh.type == "Idle"
                                            else self.rules[neigh.type])

        common = set(neighbour_sets[0])
        for s in neighbour_sets[1:]:
            common.intersection_update(s)
        return list(common)

    # ───────────────────────────────────────────
    # selection helpers  (unchanged)
    # ───────────────────────────────────────────
    def choose_random_starting_node(self):
        return self.idle_nodes[rn.randint(0, len(self.idle_nodes) - 1)]

    def choose_random_border_node(self):
        if self.border_nodes:
            return self.border_nodes[rn.randint(0, len(self.border_nodes) - 1)]
        return self.choose_random_starting_node()

    def update_border_nodes(self, node):
        for neigh in node.neighbour_nodes:
            if neigh.type == "Idle" and neigh not in self.border_nodes:
                self.border_nodes.append(neigh)

    # ───────────────────────────────────────────
    # collapse / un-collapse
    # ───────────────────────────────────────────
    def uncollapse_selected(self, node, add_to_border=True):
        prev = node.type
        node.type = "Idle"

        node.possible_collapses = list(self.types)
        if "Idle" in node.possible_collapses:
            node.possible_collapses.remove("Idle")
        node.entropy = len(node.possible_collapses)

        if node in self.types_dict.get(prev, []):
            self.types_dict[prev].remove(node)
        self.types_dict["Idle"].append(node)

        if node not in self.idle_nodes:
            self.idle_nodes.append(node)

        if add_to_border and node not in self.border_nodes:
            self.border_nodes.append(node)

    def collapse_selected(self, node, new_type):
        node.type = new_type
        node.possible_collapses = [new_type]
        self.types_dict[new_type].append(node)
        if node in self.idle_nodes:
            self.idle_nodes.remove(node)
        if node in self.border_nodes:
            self.border_nodes.remove(node)
        if node in self.types_dict["Idle"]:
            self.types_dict["Idle"].remove(node)

    def collapse_random_node(self, node):
        possible = list(node.possible_collapses)
        for banned in ("Idle", "Fire"):
            if banned in possible:
                possible.remove(banned)

        possible = [
            t for t in possible
            if self.PR.counters_types_targets[t] - self.PR.counters_types[t] >= 0
        ]
        if not possible:
            self.conflicts += 1
            return False

        # ---------- weight computation with EPS fallback ----------
        weights = [max(self.PR.probability_ratio[t], EPS_WEIGHT) for t in possible]
        total   = float(sum(weights))

        if total == 0.0:                     # safety: still impossible
            self.conflicts += 1
            return False

        weights = [w / total for w in weights]
        # -----------------------------------------------------------

        chosen = self.select_from_weighted_categories(possible, weights)
        self.PR.update_probability_ratio(chosen)
        self.collapse_selected(node, chosen)
        return True

    # ───────────────────────────────────────────
    # misc helpers  (unchanged)
    # ───────────────────────────────────────────
    def select_from_weighted_categories(self, opts, probs):
        r = rn.random()
        cum = 0.0
        for o, p in zip(opts, probs):
            cum += p
            if r <= cum:
                return o
        return opts[-1]

    @staticmethod
    def create_empty_dict(rule_dict):
        return {k: [] for k in rule_dict.keys()}


# ═════════════════════════════════════════════
# helper for GH inputs (unchanged)
# ═════════════════════════════════════════════
def str_to_dict(s):
    return ast.literal_eval(s.strip())


# ----------------- example instantiation (unchanged shell) -------------------
rules1 = str_to_dict(rules)
wfc    = WFC(graph, probability_ratio, rules1)

if RESET:
    rules2 = str_to_dict(rules)
    wfc.reset(graph, probability_ratio, rules2)
    print("Conflicts after reset:", wfc.conflicts)




# ------------------------ new loading logic-------------------------
def load_state_into_wfc(wfc, dto):
    """
    Populate an *already constructed* WFC object with a JSON/DTO state.

    Parameters
    ----------
    wfc : WFC                # a *fresh* WFC created with the same graph & rules
    dto : dict               # the state dictionary you loaded from JSON
    """

    # -----------------------------------------------------------
    # 1) Build a quick lookup: node_key  →  node object
    # -----------------------------------------------------------
    key_to_node = {}
    for i, node in enumerate(wfc.map.nodes):
        node_key = getattr(node, "id", None) \
                   or getattr(node, "Id", None) \
                   or i
        key_to_node[node_key] = node

    # -----------------------------------------------------------
    # 2) Clear dynamic WFC containers
    # -----------------------------------------------------------
    for t in wfc.types_dict:
        wfc.types_dict[t][:] = []          # empty each list in place
    wfc.idle_nodes[:]    = []
    wfc.border_nodes[:]  = []

    # -----------------------------------------------------------
    # 3) Re-apply tile states
    # -----------------------------------------------------------
    for ts in dto["tile_states"]:
        node  = key_to_node.get(ts["node_key"])
        if node is None:
            print("WARNING – unknown node key:", ts["node_key"])
            continue

        node.type               = ts["tile_type"]
        node.possible_collapses = ts["possible"]
        node.entropy            = len(node.possible_collapses)

        # bookkeeping lists
        wfc.types_dict[node.type].append(node)
        if node.type == "Idle":
            wfc.idle_nodes.append(node)

    # -----------------------------------------------------------
    # 4) Rebuild border_nodes  (idle nodes that touch a collapsed neighbour)
    # -----------------------------------------------------------
    for node in wfc.idle_nodes:
        if any(neigh.type != "Idle" for neigh in node.neighbour_nodes):
            wfc.border_nodes.append(node)

    # -----------------------------------------------------------
    # 5) Restore probability-ratio counters & meta data
    # -----------------------------------------------------------
    wfc.PR.counters_types          = dto["counters_types"]
    wfc.PR.counters_types_targets  = dto["counters_types_targets"]

    wfc.current_propagation = dto.get("current_propagation", 0)
    wfc.conflicts           = dto.get("conflicts", 0)

    # OPTIONAL – if your PR object stores probability_ratio itself
    # (e.g. you decay weights over time) restore it too:
    #
    # wfc.PR.probability_ratio = dto.get("probability_ratio",
    #                                    wfc.PR.probability_ratio)

    # -----------------------------------------------------------
    # 6) Sanity: run a quick entropy check so neighbours are consistent
    # -----------------------------------------------------------
    for node in wfc.map.nodes:
        if node.type != "Idle":
            wfc.check_node(node)   # re-propagate constraints


# ------------------ USE ----------------------------
# ➊  load JSON  →  stateDto  (you already have this part)

stateDto, stateJson = RunScript(filePath)   # your existing loader

# ➋  create a *blank* solver with the same inputs
wfc_new = WFC(graph, probability_ratio, rules)

# ➌  dress it with the saved state
load_state_into_wfc(wfc_new, stateDto)

# ➍  plug wfc_new into the rest of your definition
# ---------- end python_22 ----------
panel_15 = Panel(python_21.file_path)
panel_16 = Panel(python_21.out)

# ---- group: grid
curve_12 = Curve(curve_8)

# ----
# uncollapse lines
button_7 = Button()
cluster_4 = Cluster_2(x=curve_12, y=curve_7, wfc=cluster_3, run=button_7, in_wfc=cluster_3)

python_23 = GhPythonScript(stateDto=python_19.stateDto, stateJson=python_19.stateJson, wfc=python_20)  # -> out, out_wfc
# ---------- python_23: Python ----------
"""
GHPython:  dress  a fresh WFC instance with a saved state

IN  :  stateDto  (dict or None)
        stateJson (string, optional – not used here)
        wfc       (fresh WFC instance)

OUT :  out       (log string)
        out_wfc  (WFC instance with state applied)
"""

# ------------------------------------------------------------------
#  helper  – load_state_into_wfc
# ------------------------------------------------------------------
def load_state_into_wfc(wfc, dto):
    """
    Copy the saved DTO state into an *existing* WFC object.
    Assumes graph topology & rule set match.
    """
    # ---- 1) node-key lookup -------------------------------------
    key_to_node = {}
    for i, nd in enumerate(wfc.map.nodes):
        node_key = getattr(nd, "id", None) or getattr(nd, "Id", None) or i
        key_to_node[node_key] = nd

    # ---- 2) clear dynamic containers ----------------------------
    for t in wfc.types_dict:
        wfc.types_dict[t][:] = []
    wfc.idle_nodes[:]   = []
    wfc.border_nodes[:] = []

    # ---- 3) apply tile states -----------------------------------
    missing_keys = []
    for ts in dto["tile_states"]:
        node = key_to_node.get(ts["node_key"])
        if node is None:
            missing_keys.append(ts["node_key"])
            continue
        node.type               = ts["tile_type"]
        node.possible_collapses = ts["possible"]
        node.entropy            = len(node.possible_collapses)

        wfc.types_dict[node.type].append(node)
        if node.type == "Idle":
            wfc.idle_nodes.append(node)

    # ---- 4) rebuild border list ---------------------------------
    for nd in wfc.idle_nodes:
        if any(nb.type != "Idle" for nb in nd.neighbour_nodes):
            wfc.border_nodes.append(nd)

    # ---- 5) restore PR counters & meta --------------------------
    wfc.PR.counters_types         = dto["counters_types"]
    wfc.PR.counters_types_targets = dto["counters_types_targets"]
    wfc.current_propagation       = dto.get("current_propagation", 0)
    wfc.conflicts                 = dto.get("conflicts", 0)

    # ---- 6) sanity propagation ----------------------------------
    for nd in wfc.map.nodes:
        if nd.type != "Idle":
            wfc.check_node(nd)

    return missing_keys


# ══════════════════════════════════════════════════════════════════
# main logic of the component
# ══════════════════════════════════════════════════════════════════
log = []

if stateDto and isinstance(stateDto, dict):
    try:
        missing = load_state_into_wfc(wfc, stateDto)
        if missing:
            log.append("WARNING: {} node keys in JSON not found in graph.".format(len(missing)))
        else:
            log.append("State applied: {} tiles restored, {} conflicts.".format(
                len(stateDto["tile_states"]), wfc.conflicts))
    except Exception as e:
        log.append("ERROR dressing WFC: {}".format(e))
else:
    log.append("No stateDto supplied – using fresh WFC.")

# outputs
out      = "\n".join(log)
out_wfc  = wfc
# ---------- end python_23 ----------

# ---- group: grid
curve_13 = Curve(curve_8)

# ----
# collapse Fire ways
button_8 = Button()
cluster_5 = Cluster(x=curve_13, y=curve_6, run=button_8, wfc=cluster_4, in_wfc=cluster_4, typology="Fire")

panel_17 = Panel(python_21.wfc_load)

# ----
# collapse all
button_9 = Button()
python_24 = GhPythonScript(in_WFC=cluster_5, step10=Button(), step_all=button_9)  # -> out, wfc, out_nodes; inputs step10: Int32; same code as python_13

python_25 = GhPythonScript(wfc=python_21.wfc_load)  # -> out, typesDict
# ---------- python_25: Python ----------
__author__ = "bjorn"
__version__ = "2025.04.17"

import rhinoscriptsyntax as rs
typesDict = wfc.types_dict
# ---------- end python_25 ----------

merge = Merge(
    Data1=ColourSwatch(SwatchColor=RGB(59, 235, 100)),
    Data2=ColourSwatch(SwatchColor=RGB(255, 5, 0)),
    Data3=ColourSwatch(SwatchColor=RGB(255, 255, 0)),
    Data4=ColourSwatch(SwatchColor=RGB(255, 14, 255)))
python_26 = GhPythonScript(in_wfc=python_21.wfc_load, in_colors=merge)  # -> out, curves, colors; inputs in_colors: list
# ---------- python_26: Python ----------
import System.Drawing.Color as Color

# dictionary contining type to RGB translations
#types_colors  = {"Red":[255,0,0],"Yellow":[255,255,0],"Green":[0,255,0]}
types_colors = {}
types = list(in_wfc.types)
types.remove("Idle") # get the types to attach to input colors, idle is made by combination and should therefore not be in list

for i in range(0,len(in_colors)): # check that it is same nr colors as types
    color = in_colors[i]

    types_colors[types[i]] = [color[0],color[1],color[2]]
print("types")
print(in_wfc.types)
print("types_colors")
print(types_colors)

# function mixing colors for all possible types for a node
def get_node_color_based_on_possible_collapses(node):
    R = 0
    G = 0
    B = 0
    possible_collapses = list(node.possible_collapses)
    print(possible_collapses)
    if "Idle" in possible_collapses:
        possible_collapses.remove("Idle")
    print("possible collapses")
    print(possible_collapses)
    for possible_collapse in possible_collapses:
        print(possible_collapse)
        print("types colors")
        print(types_colors)
        R = R + types_colors[possible_collapse][0]
        print(R)
        G = G + types_colors[possible_collapse][1]
        #print(G)
        B = B + types_colors[possible_collapse][2]
        #print(B)
    p = len(node.possible_collapses)
    color = Color.FromArgb((R/p),(G/p),(B/p))
    print(color)
    return color
# SCRIPT-----------------------------------------------------------------------
curves_list = []
colors_list = []

for node in in_wfc.map.nodes:
    node_crv = node.crv
    node_color = get_node_color_based_on_possible_collapses(node)
    curves_list.append(node_crv)
    colors_list.append(node_color)

# SET OUTPUTS ----------------------------------------------------------------
curves = curves_list
colors = colors_list
# ---------- end python_26 ----------
mcol = MeshColours(Mesh=graft(python_26.curves), Colours=graft(python_26.colors))
preview = CustomPreview(Geometry=python_26.curves, Material=ColourSwatch(SwatchColor=RGB(255, 255, 255)))

panel_18 = Panel(python_25.typesDict)

# ----
# create DTO
python_27 = GhPythonScript(wfc=python_8)  # -> out, stateDto, stateJson
# ---------- python_27: Python ----------
import json

# ────────────────────────────────────────────────────────────
# DTO Classes
# ────────────────────────────────────────────────────────────

class TileState(object):
    def __init__(self, node_num_id, tile_type, possible):
        self.node_num_id = node_num_id
        self.tile_type   = tile_type
        self.possible    = possible

    def to_dict(self):
        return {
            "node_num_id": self.node_num_id,
            "tile_type":   self.tile_type,
            "possible":    self.possible
        }

class StateDto(object):
    def __init__(self,
                 tile_states,
                 idle_node_ids,
                 border_node_ids,
                 temp_checked_ids,
                 counters_types,
                 counters_types_targets,
                 current_propagation,
                 conflicts):
        self.tile_states             = tile_states
        self.idle_node_ids           = idle_node_ids
        self.border_node_ids         = border_node_ids
        self.temp_checked_ids        = temp_checked_ids
        self.counters_types          = counters_types
        self.counters_types_targets  = counters_types_targets
        self.current_propagation     = current_propagation
        self.conflicts               = conflicts

    def to_dict(self):
        return {
            "tile_states":             [ts.to_dict() for ts in self.tile_states],
            "idle_node_ids":           self.idle_node_ids,
            "border_node_ids":         self.border_node_ids,
            "temp_checked_ids":        self.temp_checked_ids,
            "counters_types":          self.counters_types,
            "counters_types_targets":  self.counters_types_targets,
            "current_propagation":     self.current_propagation,
            "conflicts":               self.conflicts
        }
    
    def to_json(self):
        return json.dumps(self.to_dict(), indent=2)


# ────────────────────────────────────────────────────────────
# Updated builder returns a StateDto
# ────────────────────────────────────────────────────────────

def build_wfc_dto(wfc):
    # 1) Build TileState objects
    tile_states = []
    for node in wfc.map.nodes:
        ts = TileState(
            node_num_id=node.num_id,
            tile_type=node.type,
            possible=list(node.possible_collapses)
        )
        tile_states.append(ts)

    # 2) Collections by num_id
    idle_ids     = [n.num_id for n in wfc.idle_nodes]
    border_ids   = [n.num_id for n in wfc.border_nodes]
    temp_checked = [n.num_id for n in getattr(wfc, "temp_checked_nodes", [])]

    # 3) PR counters
    counters = dict(wfc.PR.counters_types)
    targets  = dict(wfc.PR.counters_types_targets)

    # 4) Scalars
    propagation = wfc.current_propagation
    conflicts   = wfc.conflicts

    # 5) Return the DTO object
    return StateDto(
        tile_states,
        idle_node_ids=idle_ids,
        border_node_ids=border_ids,
        temp_checked_ids=temp_checked,
        counters_types=counters,
        counters_types_targets=targets,
        current_propagation=propagation,
        conflicts=conflicts
    )

# ────────────────────────────────────────────────────────────
# Example Usage in GhPython
# ────────────────────────────────────────────────────────────

stateDto  = build_wfc_dto(wfc)
stateJson = stateDto.to_json()
# ---------- end python_27 ----------
panel_19 = Panel(python_27.stateJson)

python_28 = GhPythonScript(wfc=python_21.wfc_load)  # -> out, typesDict, PR, border_nodes, current_propagation, idle_nodes, temp_checked_nodes, conflicts
# ---------- python_28: Python ----------
__author__ = "bjorn"
__version__ = "2025.04.17"

import rhinoscriptsyntax as rs
typesDict = wfc.types_dict
PR = wfc.PR
rules = wfc.rules
border_nodes = wfc.border_nodes
current_propagation = wfc.current_propagation
idle_nodes = wfc.idle_nodes
temp_checked_nodes = wfc.temp_checked_nodes
conflicts = wfc.conflicts

print(wfc.border_nodes[0].id)
# ---------- end python_28 ----------
panel_20 = Panel(python_28.conflicts)
panel_21 = Panel(python_28.temp_checked_nodes)
panel_22 = Panel(python_28.idle_nodes)
panel_23 = Panel(python_28.typesDict)
panel_24 = Panel(python_28.PR)
panel_25 = Panel(python_28.current_propagation)
panel_26 = Panel(python_28.border_nodes)

# ----
# save dto as json
python_29 = GhPythonScript(stateDto=python_27.stateDto, fileName="test2", saveJson=Toggle(True))  # -> out, filePath
# ---------- python_29: Python ----------
import os
import json
import tempfile

def RunScript(stateDto, fileName, saveJson):
    # Default: where the file *would* go
    fn = (fileName or "WFCState.json").strip()
    if not fn.lower().endswith(".json"):
        fn += ".json"
    outPath = os.path.join(tempfile.gettempdir(), fn)
    
    # Serialize your DTO to JSON
    try:
        if hasattr(stateDto, "to_json"):
            json_text = stateDto.to_json()
        elif hasattr(stateDto, "to_dict"):
            json_text = json.dumps(stateDto.to_dict(), indent=2)
        elif isinstance(stateDto, dict):
            json_text = json.dumps(stateDto, indent=2)
        else:
            # Fallback: string‐ify
            json_text = str(stateDto)
    except Exception as e:
        print("Error serializing DTO:", e)
        return outPath
    
    # Write if requested
    if saveJson:
        try:
            with open(outPath, "w") as f:
                f.write(json_text)
        except Exception as e:
            print("Error writing JSON to file:", e)
    
    # Always output the path
    return outPath

filePath = RunScript(stateDto, fileName, saveJson)
# ---------- end python_29 ----------
panel_27 = Panel(python_29.filePath)
python_30 = GhPythonScript(filePath=panel_27)  # -> out, stateDto, stateJson; same code as python_4
panel_28 = Panel(python_30.out)
panel_29 = Panel(python_30.stateDto)
panel_30 = Panel(python_30.stateJson)

# ==== cluster Cluster
x = ClusterInput()
y = ClusterInput()

# ---- group: select rectangles on curves
ghpython_script = GhPythonScript(x=x, y=y)  # -> out, a; inputs x: list of Curve, y: Curve
# ---------- ghpython_script: Python ----------
import rhinoscriptsyntax as rs

def get_intersecting_rectangles(rectangles, line):
    intersecting_rectangles = []
    for rectangle in rectangles:
        if rs.IsCurveClosed(rectangle):
            intersection = rs.CurveCurveIntersection(rectangle, line)
            if intersection and len(intersection) > 0:
                intersecting_rectangles.append(rectangle)
    return intersecting_rectangles

a = get_intersecting_rectangles(x, y)
# ---------- end ghpython_script ----------

# ----
wfc = ClusterInput()
run = ClusterInput()
in_wfc = ClusterInput()
typology = ClusterInput()

# ----
# find nodes corresponding to selected tiles
# custom collapse those nodes
curve = Curve(ghpython_script.a)
brep = Brep(curve)
area = Area(Geometry=brep)  # -> Area, flatten(Centroid)
ghpython_script_2 = GhPythonScript(wfc=wfc, selected_centroids=area.Centroid)  # -> out, a, custom_sel_nodes, custom_sel_pts; inputs selected_centroids: list of Point3d
# ---------- ghpython_script_2: Python ----------
def make_coo(pt):
    coo = [int(pt[0]*10000),int(pt[1]*10000)]
    return coo

# XXXXXXXXXXXXXXXXXXXXXXXXXXXXXXXXXXXXXXXXXXXXXXXXXXXXXXX
# select nodes

sel_nodes = []
sel_nodes_pts = []
for c in selected_centroids:
    coo = make_coo(c)
    key = "{a},{b}".format(a=coo[0],b=coo[1]) # theres is a dict with the coordinates for each point that gives back the node
    print(key)
    node = wfc.map.coo_dict[key]
    pt = node.node_pt
    sel_nodes.append(node)
    sel_nodes_pts.append(pt)

custom_sel_nodes = sel_nodes
custom_sel_pts = sel_nodes_pts
# ---------- end ghpython_script_2 ----------
point = Point(ghpython_script_2.custom_sel_pts)
ghpython_script_3 = GhPythonScript(RUN=run, in_WFC=in_wfc, nodes_to_collapse=ghpython_script_2.custom_sel_nodes, typology=typology)  # -> out, a, wfc; inputs nodes_to_collapse: list
# ---------- ghpython_script_3: Python ----------
if RUN == True:
    print(len(in_WFC.idle_nodes))
    for node in nodes_to_collapse:
        if node in in_WFC.idle_nodes:
            in_WFC.collapse_selected(node, typology)
    print(len(in_WFC.idle_nodes))

wfc = in_WFC
# ---------- end ghpython_script_3 ----------

wfc_2 = ClusterOutput(ghpython_script_3.wfc)

# ==== cluster Cluster_2
x = ClusterInput()
y = ClusterInput()

# ---- group: select rectangles on curves
ghpython_script = GhPythonScript(x=x, y=y)  # -> out, a; inputs x: list of Curve, y: Curve; same code as ghpython_script

# ----
wfc = ClusterInput()
run = ClusterInput()
in_wfc = ClusterInput()

# ----
# find nodes corresponding to selected tiles
# un collapse nodes
curve = Curve(ghpython_script.a)
brep = Brep(curve)
area = Area(Geometry=brep)  # -> Area, flatten(Centroid)
ghpython_script_2 = GhPythonScript(wfc=wfc, selected_centroids=area.Centroid)  # -> out, a, custom_sel_nodes, custom_sel_pts; inputs selected_centroids: list of Point3d; same code as ghpython_script_2
panel = Panel(ghpython_script_2.custom_sel_nodes)
point = Point(ghpython_script_2.custom_sel_pts)
ghpython_script_3 = GhPythonScript(RUN=run, in_WFC=in_wfc, nodes_to_uncollapse=ghpython_script_2.custom_sel_nodes)  # -> out, a, wfc; inputs nodes_to_uncollapse: list
# ---------- ghpython_script_3: Python ----------
if RUN == True: # TODO make sure to roll back probability ratio as well in that code
    print(len(in_WFC.idle_nodes))
    for node in nodes_to_uncollapse:
        if not (node in in_WFC.idle_nodes):
            in_WFC.uncollapse_selected(node)
    print(len(in_WFC.idle_nodes))

wfc = in_WFC
# ---------- end ghpython_script_3 ----------
panel_2 = Panel(ghpython_script_3.wfc)

wfc_2 = ClusterOutput(ghpython_script_3.wfc)
